# Grasshopper definition Chapter1_AlgorithmsAndData.gh (Grasshopper 1.0.7)

# Chapter One: Algorithms and Data
# Algorithms
# Building algorithms
# --------------------------------
# There are three building blocks to any algorithm
# Data
# Color code the algorithmic solution
panel = Panel("INPUT")  # disabled
# Input
# Intermediate
# Input and Processes
# Recognizing algorithm parts and how to label and color-code them
# Input (2 numbers)
panel_2 = Panel("Add 2 numbers")  # disabled

# ----
# Solution:
# Create a circle that is twice as large as one that goes through three given points. One of the points is described by its coordinates.
# Input
panel_3 = Panel("1")  # disabled
panel_4 = Panel("3")  # disabled
panel_5 = Panel("1,2,0")  # disabled
panel_6 = Panel("2,3,1")  # disabled
# Designing Algorithms
# The four-step process
# The 4-steps to designing an algorithm:
# --------------------------------------
# 1- Think about the result first [output]
# 2- Identify key calculation method to reach the output [key processes(s)]
# 3- Identify data needed for calculation [Input].
# 5- Define intermediate steps to generate missing data [Intermediate processes(s)]
panel_7 = Panel("2")  # disabled
panel_8 = Panel("0.5")  # disabled

panel_9 = Panel("2")  # disabled
# Input
# (a point and radius)
panel_10 = Panel("0,0,0")  # disabled

# ----
# Create a circle on the XY-Plane from a given center and radius
panel_11 = Panel("2")  # disabled
panel_12 = Panel("1")  # disabled

# ----
# Tutorial 1:
# Write a description of what the following lgorithm does, identify input, processes and output, then label and color-code the parts.
# Add any extra data or processes to make it more readable.
panel_13 = Panel("1")  # disabled
panel_14 = Panel("0.5")  # disabled
panel_15 = Panel("3")  # disabled
# Intermediate process
pt = ConstructPoint(XCoordinate=panel_3, YCoordinate=panel_8, ZCoordinate=panel_4)  # disabled
pt_2 = ConstructPoint(XCoordinate=panel_13, YCoordinate=panel_14, ZCoordinate=panel_15)  # disabled
panel_16 = Panel("2,3,1")  # disabled
# Input
# (2 numbers)
panel_17 = Panel("1")  # disabled
# 3- Input
# Example2: Create a circle on XY-Plane from center and radius
# 1- Output: Circle.
# 2- Key process: Circle component from "Plane" and "Radius"
# 3- Input: Center and Radius
# 4- Intermediate process: Plane is missing, so generate XY-Plane through Center
panel_18 = Panel("2")  # disabled
# Example1: Adding 2 numbers
# 1- Output: Sum
# 2- Key process: Addition component
# 3- Input: 2 numbers
# 4- Intermediate process: None
# Output
# (Sum)
# 1- Output
panel_19 = Panel("")  # disabled
# Key process
# (Addition)
# 2- Key Process
addition = Addition()  # disabled
# Intermediate process
# (generate a plane)
pln = Plane(panel_10)  # disabled
# Input
# (point & number)
# 4- Intermediate input
# and processes
panel_20 = Panel("0,0,0")  # disabled
# Example3:
# Use the 4-Step process to create an algorithm to generate a line from 2 points. One point is referenced from Rhino, and the other is created using three coordinates (x=1, y=0.5 and z=3).
panel_21 = Panel("2")  # disabled
# Key process
# (Generate Circle)
# 2- Key Process
cir = Circle(Plane=PlaneXY(0, 0, 0), Radius=1)  # disabled
panel_22 = Panel("2")  # disabled
# Output
# (Circle)
# 1- Output
circle = Circle()  # disabled
# Input
# (point & number)
# 3- Input
panel_23 = Panel("0,0,0")  # disabled
# Input
# (point & number)
panel_24 = Panel("1")  # disabled
# 4- Intermediate input
# and processes
panel_25 = Panel("0.5")  # disabled
panel_26 = Panel("3")  # disabled
# Key process
# (Line from 2 points)
# 2- Key Process
ln = Line()  # disabled
# Input
# (point & number)
panel_27 = Panel("1")  # disabled
# 3- Input
panel_28 = Panel("3")  # disabled
panel_29 = Panel("0.5")  # disabled
pt_3 = Point(Point(-17.64143829, -14.80819637, 0))  # disabled
# Output
# (Line geometry)
# 1- Output
geo = Geometry()  # disabled
pt_4 = Point(Point(-17.64143829, -14.80819637, 0))  # disabled
panel_30 = Panel(pt)  # disabled
panel_31 = Panel("1,2,0")  # disabled
# Processes
# Processes
panel_32 = Panel("ALGORITHM STEPS")  # disabled
circle_2 = Circle3Pt(PointA=pt_2, PointB=panel_31, PointC=panel_16)  # -> Circle, Plane, Radius; disabled
# Key process
circle_3 = Circle3Pt(PointA=pt, PointB=panel_5, PointC=panel_6)  # -> Circle, Plane, Radius; disabled
# Output
# (Sum)
panel_33 = Panel(addition)  # disabled
# Key process (addition)
addition_2 = Addition(A=panel_12, B=panel_11)  # disabled
# Key process
# (calculate the circle)
cir_2 = Circle(Plane=pln, Radius=panel_9)  # disabled
# Intermediate process
# (Generate point)
pt_5 = ConstructPoint(XCoordinate=panel_24, YCoordinate=panel_25, ZCoordinate=panel_26)  # disabled
# Key process
# (Generate Circle)
cir_3 = Circle(Plane=PlaneXY(0, 0, 0), Radius=panel_22)  # disabled
# Key process
# (Addition)
addition_3 = Addition(A=panel_17, B=panel_18)  # disabled
# Output
# (Circle)
circle_4 = Circle(cir)  # disabled
# Intermediate process
# (Generate Plane)
pln_2 = Plane(panel_20)  # disabled
scale = Scale(Geometry=circle_2.Circle, Center=circle_2.Plane, Factor=2)  # -> Geometry, Transform; disabled
# Output
# (Line geometry)
geo_2 = Geometry(ln)  # disabled
# Key process
# (Line from 2 points)
ln_2 = Line(EndPoint=pt_4)  # disabled
# Intermediate process
deplane = DeconstructPlane(Plane=circle_3.Plane)  # -> Origin, XAxis, YAxis, ZAxis; disabled
# Key process
# (Generate Circle)
cir_4 = Circle(Plane=pln_2, Radius=panel_21)  # disabled
# Key process
# (Line from 2 points)
ln_3 = Line(StartPoint=pt_5, EndPoint=pt_3)  # disabled
# Output
# (Circle)
circle_5 = Circle(cir_3)  # disabled
# Output
# (Sum)
panel_34 = Panel(addition_3)  # disabled
# Output (sum)
panel_35 = Panel(addition_2)  # disabled
# Output
# (Line geometry)
geo_3 = Geometry(ln_2)  # disabled
# Output
# (the circle curve)
circle_6 = Circle(cir_2)  # disabled
# Data
# Output
panel_36 = Panel("OUTPUT")  # disabled
# Key process
scale_2 = Scale(Geometry=circle_3.Circle, Center=deplane.Origin, Factor=panel_7)  # -> Geometry, Transform; disabled
# Output
# (Circle)
circle_7 = Circle(cir_4)  # disabled
# Output
# (Line geometry)
geo_4 = Geometry(ln_3)  # disabled
# Output
geo_5 = Geometry(scale_2.Geometry)  # disabled

# ---- group: Number as parameter (can be changed)
number_slider = Slider(0.732, range=0..1)  # disabled

# ---- group: Set internally as single item
# Internal
# (set inside the parameter/component)
pt_6 = Point(Point(4, 4, 0))  # disabled

# ---- group: Set internally as a list
pt_7 = Point([Point(10, 10, 0), Point(17, 5, 0), Point(15, 15, 0)])  # disabled

# ---- group: Set internally as constant (fixed)
num = Number(0.25)  # disabled

# ----
# Tutorial sources
# Indicate what is the source of highlighted data (internal, referenced or supplied)
end = EndPoints(Curve=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)  # -> Start, End; disabled

# ---- group: Internal
panel_37 = Panel("4,4,2")  # disabled

num_2 = Number([3.14, 10.3])  # disabled

# ----
addition_4 = Addition(A=num_2, B=num_2)  # disabled
# Data
panel_38 = Panel("Data sources")  # disabled
panel_39 = Panel(pt_6)  # disabled
panel_40 = Panel(pt_7)  # disabled
panel_41 = Panel(num)  # disabled
panel_42 = Panel(number_slider)  # disabled

# ---- group: Supplied
pt_8 = Point(end.Start)  # disabled

pt_9 = Point(panel_37)  # disabled

panel_43 = Panel(addition_4)  # disabled

# ---- group: Referenced
pt_10 = Point(<point referenced from the Rhino model>)  # disabled

# ----
panel_44 = Panel("""Referenced
(from a document)""")  # disabled

# ---- group: Right mouse click the component, then "Set one point" to reference in Rhino
pt_11 = Point()  # disabled

# ---- group: Image linked to a file
image = ImageSampler(
    FilePath="C:\Users\Rajaa Issa\Desktop\EssentialAlgorithmsAndDataStructures\Images\02_07_dot.png",
    Filter="Colour",
    Interpolate=False,
    Umax=1,
    Umin=0,
    Vmax=1,
    Vmin=0,
    Wrap=1)  # disabled

# ----
panel_45 = Panel(pt_11)  # disabled
panel_46 = Panel("3,2.5,0")  # disabled

# ---- group: constant
panel_47 = Panel("6")  # disabled

# ---- group: Set internally
line = Line(Line((-22, -7, 0), (5, 12, 0)))  # disabled

# ---- group: Constant
line_2 = Line(Line((-22, -7, 0), (5, 12, 0)))  # disabled

# ----
divide = DivideCurve(Curve=line_2, Count=panel_47, Kinks=False)  # -> Points, Tangents, Parameters; disabled
len = Length(Curve=line)  # disabled

# ---- group: Set internally
# Extrernal
# (supplied to the component)
pt_12 = Point(Point(4, 4, 0))  # disabled

# ---- group: Externally supplied data take precedent
pt_13 = Point(panel_46)  # disabled

# ----
panel_48 = Panel(len)  # disabled
panel_49 = Panel(divide.Tangents)  # disabled
panel_50 = Panel(pt_12)  # disabled
panel_51 = Panel(pt_13)  # disabled
panel_52 = Panel(divide.Points)  # disabled
panel_53 = Panel(divide.Parameters)  # disabled
panel_54 = Panel("Data types")  # disabled
move = Move(Motion=Vector(1.5, 3, 6))  # -> Geometry, Transform; disabled
# System data types
bool = Boolean(True)  # disabled

# ---- group: String (Text)
txt = Text("Hello!")  # disabled

# ---- group: Real number
num_3 = Number(30)  # disabled

# ---- group: Points
# Geometry data types
pt_14 = Point(Point(1, 2, 0))  # disabled

# ---- group: Lines
line_3 = Line(Line((-1, 2, 0), (1, 6, 0)))  # disabled

# ---- group: Circles
circle_8 = Circle({Plane=Plane(origin=(3, 1, 0), x=(0.7071067812, -0.7071067812, 0), y=(0.7071067812, 0.7071067812, 0)), Radius=1.414213562})  # disabled

# ---- group: Color
col = Colour(RGB(209, 46, 255))  # disabled

# ---- group: Domain or interval
# Data types common in computer graphics
domain = Domain(Domain(0, 15))  # disabled

# ----
transform = Transform(move.Transform)  # disabled
vec = Vector(Vector(48.37352419, 43.59607812, 0))  # disabled
pln_3 = Plane(Plane(origin=(75.43321361, 56.35190425, 0), x=(0.9207906492, -0.39005715, 0), y=(0.39005715, 0.9207906492, 0)))  # disabled
# GH ignores when possible (which is hard to find error)
panel_55 = Panel("100")  # disabled
panel_56 = Panel("5")  # disabled
panel_57 = Panel("100")  # disabled

# ---- group: Ignored because there is newline and cannot be casted as number
# Data types tutorial
# Where do you find data type parameters in GH menu?
# What is the difference between primitive and heometry types?
# Explore the different data types supported by GH and list at least 5 that has not been mentioned above
panel_58 = Panel("5")  # disabled

# ---- group: Numbers as text
panel_59 = Panel("100")  # disabled
# Cast when a component can process more
# than one type to resolve ambiguity
panel_60 = Panel("99")  # disabled

panel_61 = Panel("99")  # disabled
panel_62 = Panel("100")  # disabled

# ----
# Data conversion (casting)
panel_63 = Panel("12AB")  # disabled
panel_64 = Panel("12")  # disabled

# ---- group: Primitive types
int = Integer()  # disabled
C = Complex()  # disabled
time = Time()  # disabled

# ----
panel_65 = Panel(pln_3)  # disabled
panel_66 = Panel(domain)  # disabled
panel_67 = Panel(vec)  # disabled
matrix = TransformMatrix(transform, Digits=3)  # disabled

# ---- group: Diplay color
preview = CustomPreview(Geometry=circle_8, Material=col)  # disabled

# ---- group: RGB value
panel_68 = Panel(col)  # disabled

# ----
panel_69 = Panel(bool)  # disabled
panel_70 = Panel(txt)  # disabled
panel_71 = Panel(num_3)  # disabled
panel_72 = Panel(pt_14)  # disabled
panel_73 = Panel(line_3)  # disabled
addition_5 = Addition(A=panel_55, B=panel_56)  # disabled
addition_6 = Addition(A=panel_57, B=panel_58)  # disabled
num_4 = Number(panel_58)  # disabled

# ---- group: Cast to number
num_5 = Number(panel_61)  # disabled
num_6 = Number(panel_62)  # disabled

# ----
num_7 = Number(panel_63)  # disabled
num_8 = Number(panel_64)  # disabled

# ---- group: Geometry types
brep = Brep()  # disabled
crv = Curve()  # disabled
srf = Surface()  # disabled

# ----
panel_74 = Panel(addition_5)  # disabled
# expected 105
panel_75 = Panel(addition_6)  # disabled

# ---- group: Component process both text and numbers
expression = Expression(x=panel_60, y=panel_59, Expression="x>y")  # disabled

expression_2 = Expression(x=num_5, y=num_6, Expression="x>y")  # disabled

# ---- group: Componbent cast to numbers
larger = LargerThan(FirstNumber=panel_61, SecondNumber=panel_62)  # -> LargerThan, OrEqualTo; disabled

# ----
panel_76 = Panel(larger.LargerThan)  # disabled

# ---- group: Different result based on type
# Same input, different output!
panel_77 = Panel(expression)  # disabled
panel_78 = Panel(expression_2)  # disabled

# ----
panel_79 = Panel("Processing Data")  # disabled

# ---- group: Input numbers
num_9 = Number([35, 61.2, 21.3, 2, 67.3])  # disabled

# ---- group: Input (radius)
# Solution: Force the sphere radius to be no less than1
number_slider_2 = Slider(3.4, range=-5..10)  # disabled

# ---- group: radius
# Ex: draw sphere only when radius in between 2 and 6 (regardless of input)
number_slider_3 = Slider(-1, range=-1..10)  # disabled

number_slider_4 = Slider(-1, range=-1..10)  # disabled

# ---- group: Set input to be < min
number_slider_5 = Slider(-2.8, range=-5..10)  # disabled

# ---- group: Target domain
panel_80 = Panel("3 to 9")  # disabled

# ---- group: Input numbers
num_10 = Number([12.98687702, 7.996611289, 4.757581917, 15.89663992, 3.982463016, 6.670853549, 13.40911027, 8.559434834, 5.559770894, 2.65241048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])  # disabled

# ----
# Input
number_slider_6 = Slider(3.4, range=-5..10)  # disabled

# ---- group: Show all values in a panel
# Data Analysis
panel_81 = Panel(num_9)  # disabled

# ----
# Flow control tutorial
# What is the purpose of the following algorithm?
# Notate and color code to describe the purpose of each part.
number_slider_7 = Slider(3.4, range=-5..10)  # disabled

# ---- group: Angle in degrees
panel_82 = Panel("60")  # disabled

# ----
panel_83 = Panel("Operations inside expressions")  # disabled

panel_84 = Panel("10.6")  # disabled
panel_85 = Panel("6.35")  # disabled

# ----
# Numbers are treated as text in String operations
panel_86 = Panel("10.6")  # disabled
panel_87 = Panel("6.35")  # disabled

# ----
# Ex: create a sphere with a radius (input -1 to +10)
# Note how Grasshopper ignores negative (invalid) input
panel_88 = Panel("Logical gates")  # disabled

# ---- group: Input numbers
# Data Selection
num_11 = Number([35, 61.2, 21.3, 2, 67.3])  # disabled

# ---- group: Min radius
panel_89 = Panel("1")  # disabled

# ----
panel_90 = Panel("Expression inside input")  # disabled

# ---- group: Min radius
# Data processing tutorial
# Given a list of point coordinates, do the following:
# 1- Analyze the list to understand the data.
# 3- Remap the coordinates to be between 3 and 9.
# 3- Construct a point list of type points.
# 
# Note that the list is organized so that the first 3 numbers refer to the x,y,z of the first point, the second 3 numbers belong to the second point and so on.
panel_91 = Panel("1")  # disabled

# ----
# Logical Operations
panel_92 = Panel("10.6")  # disabled
panel_93 = Panel("6.35")  # disabled

panel_94 = Panel("6.35")  # disabled
# Numeric Operations
panel_95 = Panel("10.6")  # disabled

# ---- group: Input numbers
# Data Mapping
num_12 = Number([1, 2, 3, 4, 5, 6, 7, 8])  # disabled

# ---- group: Bounds
panel_96 = Panel("2")  # disabled
panel_97 = Panel("6")  # disabled

# ---- group: Input numbers
num_13 = Number([35, 61.2, 21.3, 2, 67.3])  # disabled

# ---- group: Input pattern
bool_2 = CullPattern([True, False])  # disabled

# ----
panel_98 = Panel("1")  # disabled

# ---- group: Number of steps
panel_99 = Panel("4")  # disabled

# ----
# Data Sorting
num_14 = Number([35, 61.2, 21.3, 2, 67.3])  # disabled

# ---- group: source domain
bnd = Bounds(Numbers=num_10)  # disabled

# ----
panel_100 = Panel(num_12)  # disabled

graph = QuickGraph(num_10, SortOrder=0)  # disabled
viewer = ParamViewer(num_10)  # disabled

panel_101 = Panel("1")  # disabled

# ---- group: Input curve
crv_2 = Curve(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)  # disabled

# ---- group: Angles in degrees
panel_102 = Panel("45")  # disabled
panel_103 = Panel("90")  # disabled
panel_104 = Panel("180")  # disabled

# ----
panel_105 = Panel(bool_2)  # disabled
panel_106 = Panel(num_11)  # disabled
expression_3 = Expression(x=panel_84, y=panel_85, Expression="(x+y)*y")  # disabled
number_slider_8 = Slider(4, range=0..10)  # disabled

# ---- group: Check if input radius is less than min
larger_2 = LargerThan(FirstNumber=number_slider_2, SecondNumber=panel_89)  # -> LargerThan, OrEqualTo; disabled
not = GateNot(A=larger_2.OrEqualTo)  # disabled

# ----
concat = Concatenate(FragmentA=panel_86, FragmentB=panel_87)  # disabled
expression_4 = Expression(x=panel_86, y=panel_87, Expression="Format(\"{0}{1}\", x, y)")  # disabled

# ---- group: Test within a bound
larger_3 = LargerThan(FirstNumber=number_slider_4, SecondNumber=panel_96)  # -> LargerThan, OrEqualTo; disabled
smaller = SmallerThan(FirstNumber=number_slider_4, SecondNumber=panel_97)  # -> SmallerThan, OrEqualTo; disabled
and = GateAnd(A=larger_3.OrEqualTo, B=smaller.OrEqualTo)  # disabled

# ---- group: Check if input radius is less than min
larger_4 = LargerThan(FirstNumber=number_slider_5, SecondNumber=panel_91)  # -> LargerThan, OrEqualTo; disabled
not_2 = GateNot(A=larger_4.OrEqualTo)  # disabled

# ---- group: Use series of GH componentd
rad = Radians(Degrees=panel_82)  # disabled
fac = Factorial(Number=panel_82)  # disabled
sin = Sine(Value=rad)  # disabled
addition_7 = Addition(A=fac, B=sin)  # disabled

# ----
larger_5 = LargerThan(FirstNumber=panel_92, SecondNumber=panel_93)  # -> LargerThan, OrEqualTo; disabled

# ---- group: Initial input
panel_107 = Panel(num_14)  # disabled

# ---- group: Use expression
expression_5 = Expression(n=panel_82, Expression="n! + Sin(Rad(n))")  # disabled

# ----
addition_8 = Addition(A=panel_95, B=panel_94)  # disabled
multiplication = Multiplication(A=addition_8, B=panel_94)  # disabled

# ---- group: Show data structure
viewer_2 = ParamViewer(num_9)  # disabled

# ---- group: # elements in the range = N+1
range = Range(Domain=Domain(0, 1), Steps=panel_99)  # disabled

# ---- group: # elements in the range = N
range_2 = Range(Domain=Domain(0, 1), Steps=expr("x-1", panel_99))  # disabled

# ----
# Some special logic
larger_6 = LargerThan(FirstNumber=number_slider_6, SecondNumber=panel_98)  # -> LargerThan, OrEqualTo; disabled

# ---- group: Sort assending
sort = SortList(Keys=num_14)  # -> Keys, ValuesA; disabled

# ----
remap = RemapNumbers(Value=num_10, Source=bnd, Target=panel_80)  # -> Mapped, Clipped; disabled
bnd_2 = Bounds(Numbers=num_12)  # disabled

# ---- group: Target domain
domain_2 = Target(Domain(0, 1))  # disabled

# ----
larger_7 = LargerThan(FirstNumber=number_slider_7, SecondNumber=panel_101)  # -> LargerThan, OrEqualTo; disabled
toggle = BooleanToggle(False)  # disabled
panel_108 = Panel(num_13)  # disabled

# ---- group: Reparameterize
crv_3 = Curve(reparameterize(crv_2))  # disabled

# ----
not_3 = GateNot(A=larger_6.OrEqualTo)  # disabled

# ---- group: Select using pattern
cull = CullPattern(List=num_13, CullPattern=bool_2)  # disabled

# ----
not_4 = GateNot(A=larger_7.OrEqualTo)  # disabled

# ---- group: Sorted list
panel_109 = Panel(sort.Keys)  # disabled

# ---- group: Convert angle from degrees to radians
rad_2 = Radians(Degrees=[panel_102, panel_104, panel_103])  # disabled

# ----
panel_110 = Panel(larger_5.LargerThan)  # disabled
panel_111 = Panel(bnd_2)  # disabled
panel_112 = Panel(domain_2)  # disabled
panel_113 = Panel(expression_3)  # disabled

# ---- group: Remap
remap_2 = RemapNumbers(Value=num_12, Source=bnd_2, Target=domain_2)  # -> Mapped, Clipped; disabled

# ---- group: Select list item
item = ListItem(List=num_11, Index=number_slider_8, Wrap=toggle)  # disabled

# ----
domain_3 = Domain(crv_3)  # disabled
graph_2 = QuickGraph(remap.Mapped, SortOrder=0)  # disabled
domain_4 = Domain(crv_2)  # disabled

# ---- group: Filter data under condition
dispatch = Dispatch(List=number_slider_4, DispatchPattern=and)  # -> ListA, ListB; disabled

# ----
panel_114 = Panel(and)  # disabled
panel_115 = Panel([number_slider_6, panel_98])  # disabled
panel_116 = Panel([larger_6.OrEqualTo, not_3])  # disabled

# ---- group: Graph all values
graph_3 = QuickGraph(num_9, SortOrder=0)  # disabled

# ----
panel_117 = Panel([number_slider_7, panel_101])  # disabled
panel_118 = Panel([larger_7.OrEqualTo, not_4])  # disabled
panel_119 = Panel(multiplication)  # disabled

# ---- group: Select radius that satisfy the condition / Selection pattern
panel_120 = Panel([larger_2.OrEqualTo, not])  # disabled

# ---- group: Select radius that satisfy the condition
panel_121 = Panel([number_slider_2, panel_89])  # disabled
dispatch_2 = Dispatch(List=panel_121, DispatchPattern=panel_120)  # -> ListA, ListB; disabled

# ----
panel_122 = Panel(cull)  # disabled

# ---- group: Select radius that satisfy the condition / Selection pattern
panel_123 = Panel([larger_4.OrEqualTo, not_2])  # disabled

# ---- group: Select radius that satisfy the condition
panel_124 = Panel([number_slider_5, panel_91])  # disabled
dispatch_3 = Dispatch(List=panel_124, DispatchPattern=panel_123)  # -> ListA, ListB; disabled

# ----
panel_125 = Panel(expression_5)  # disabled
panel_126 = Panel(addition_7)  # disabled
panel_127 = Panel(range)  # disabled
panel_128 = Panel(range_2)  # disabled
panel_129 = Panel(domain_4)  # disabled
panel_130 = Panel(domain_3)  # disabled
panel_131 = Panel(concat)  # disabled
panel_132 = Panel(expression_4)  # disabled
dispatch_4 = Dispatch(List=panel_115, DispatchPattern=panel_116)  # -> ListA, ListB; disabled
panel_133 = Panel(item)  # disabled

# ---- group: Data values
panel_134 = Panel(remap_2.Mapped)  # disabled

# ----
dispatch_5 = Dispatch(List=panel_117, DispatchPattern=panel_118)  # -> ListA, ListB; disabled

# ---- group: Angles in Radian
panel_135 = Panel(rad_2)  # disabled

# ---- group: Reverse list
rev = ReverseList(List=sort.Keys)  # disabled

# ---- group: Generate the spherer
sph = Sphere(Base=PlaneXY(0, 0, 0), Radius=number_slider_3)  # disabled

# ---- group: Generate the sphere
sph_2 = Sphere(Base=PlaneXY(0, 0, 0), Radius=dispatch.ListA)  # disabled

# ----
# Output
sph_3 = Sphere(Base=PlaneXY(0, 0, 0), Radius=dispatch_4.ListA)  # disabled
sph_4 = Sphere(Base=PlaneXY(0, 0, 0), Radius=dispatch_5.ListA)  # disabled

# ---- group: Data graph
graph_4 = QuickGraph(num_12, SortOrder=0)  # disabled

graph_5 = QuickGraph(remap_2.Mapped, SortOrder=0)  # disabled

# ---- group: Source domain
bnd_3 = Bounds(Numbers=num_9)  # disabled

# ----
avr = Average(Input=num_9)  # disabled
panel_136 = Panel("""True
False
False""")  # disabled
panel_137 = Panel("""False
True
False""")  # disabled
panel_138 = Panel("""False
False
True""")  # disabled

# ---- group: Reversed order
panel_139 = Panel(rev)  # disabled

# ---- group: Output sphere
geo_6 = Geometry(sph)  # disabled

geo_7 = Geometry(sph_2)  # disabled

# ----
geo_8 = Geometry(sph_3)  # disabled

# ---- group: Generate a sphere
sph_5 = Sphere(Base=PlaneXY(0, 0, 0), Radius=dispatch_2.ListA)  # disabled

sph_6 = Sphere(Base=PlaneXY(0, 0, 0), Radius=dispatch_3.ListA)  # disabled

# ---- group: Selected radius
panel_140 = Panel(dispatch_2.ListA)  # disabled

panel_141 = Panel(dispatch_3.ListA)  # disabled

# ----
geo_9 = Geometry(sph_4)  # disabled

# ---- group: Every 3rd number starting with 0
cull_2 = CullPattern(List=remap.Mapped, CullPattern=panel_136)  # disabled

# ---- group: Every 3rd number starting with 1
cull_3 = CullPattern(List=remap.Mapped, CullPattern=panel_137)  # disabled

# ---- group: Every 3rd number starting with 2
cull_4 = CullPattern(List=remap.Mapped, CullPattern=panel_138)  # disabled

# ----
panel_142 = Panel(bnd_3)  # disabled
panel_143 = Panel(avr)  # disabled

# ---- group: Output
geo_10 = Geometry(sph_5)  # disabled

geo_11 = Geometry(sph_6)  # disabled

# ---- group: Z list
num_15 = Number(cull_4)  # disabled

# ---- group: X list
num_16 = Number(cull_2)  # disabled

# ---- group: Y list
num_17 = Number(cull_3)  # disabled

# ---- group: Construct point list
pt_15 = ConstructPoint(XCoordinate=num_16, YCoordinate=num_17, ZCoordinate=num_15)  # disabled

# ----
viewer_3 = ParamViewer(pt_15)  # disabled
panel_144 = Panel("""1
2
3
4
5
6
7
8
9
10
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""")  # disabled
# Tutorial:
# Analyze the total time consumed to solve the following (use profiler).
# Explore alternative solution that takes less time.
panel_145 = Panel("""1
2
3
4
5
6
7
8
9
10
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""")  # disabled
# In general: geometry creation is much more
# time consuming than transformation (moving, rotating, etc)
panel_146 = Panel("""1
2
3
4
5
6
7
8
9
10
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""")  # disabled
panel_147 = Panel("1000000")  # disabled
# 5- Long processing time
# Some algorithms are time consuming. Debug with small set of data before committing the time only to discover there is bug.
# Time consuming operations
panel_148 = Panel("10000")  # disabled
# Pitfalls of algorithmic design
# 1- Wrong type (string instead of number)
#  Notice errors ("red" or "orange" components). Always double check input (hook to a panel or parameter viewer, label input)
# Input
# (list of numbers)
# Wrong input type!
panel_149 = Panel("""2
3""")  # disabled
Z = UnitZ(Factor=panel_145)  # disabled
Z_2 = UnitZ(Factor=panel_144)  # disabled
# Easy to mix input
panel_150 = Panel("3")  # disabled
panel_151 = Panel("16.5")  # disabled
panel_152 = Panel("4.2")  # disabled
# Input
# (curve and parameter)
panel_153 = Panel("0.5")  # disabled
panel_154 = Panel("4.2")  # disabled
# 4- Mismatched data structure
# Test all input data structure before feeding into a component.
# Think about the desired matching (data matching will be explained later).
panel_155 = Panel("3")  # disabled
# 2- Incorrect input
# Check how a component process data, and the value of input before feeding into a component.
# Input
# (curve and parameter)
crv_4 = Curve(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)  # disabled
panel_156 = Panel("16.5")  # disabled
panel_157 = Panel("16.5")  # disabled
# Check domain, reparameterize or find mid domain, or use proper component
panel_158 = Panel("0.5")  # disabled
# View and align input
panel_159 = Panel("0.5")  # disabled
# Consolidate/simplify porcesses when possible
panel_160 = Panel("0.5")  # disabled

panel_161 = Panel("10.6")  # disabled
panel_162 = Panel("6.35")  # disabled

crv_5 = Curve(crv_4)  # disabled
panel_163 = Panel("0.5")  # disabled
num_18 = Number([1, 2, 3])  # disabled
num_19 = Number([1, 2, 3, 4])  # disabled
num_20 = Number(graft([1, 2, 3]))  # disabled
# Mismatched length
num_21 = Number([1, 2, 3])  # disabled
# Mismatched data structure
num_22 = Number([1, 2, 3])  # disabled

# ---- group: Run expensive processes min #times
circle_9 = Circle({Plane=Plane(origin=(6.899897171, 11.46799198, 0), x=(0.6757246285, -0.7371541402, 0), y=(0.7371541402, 0.6757246285, 0)), Radius=2.413893414})  # disabled
boundary = BoundarySurfaces(Edges=circle_9)  # disabled

# ----
circle_10 = Circle({Plane=Plane(origin=(6.899897171, 11.46799198, 0), x=(0.6757246285, -0.7371541402, 0), y=(0.7371541402, 0.6757246285, 0)), Radius=2.413893414})  # disabled
circle_11 = Circle({Plane=Plane(origin=(6.899897171, 11.46799198, 0), x=(0.6757246285, -0.7371541402, 0), y=(0.7371541402, 0.6757246285, 0)), Radius=2.413893414})  # disabled

# ---- group: Input rectangle
rec = Rectangle({Plane=PlaneXY(0, 0, 0), Size=Domain2(u=-1..1, v=-1..1)})  # disabled

# ---- group: Angel in degrees
panel_164 = Panel("45")  # disabled

# ----
# 6- Poor organization
# Poorly organized definition is not easy to debug, understand, reuse or modify
# Poor organization
image_2 = ImageSampler(
    FilePath="C:\Users\Rajaa Issa\Desktop\EssentialAlgorithmsAndDataStructures\Images\01_02_PoorOrganization.png",
    Filter="Colour",
    Interpolate=False,
    Umax=1,
    Umin=0,
    Vmax=1,
    Vmin=0,
    Wrap=1)  # disabled
# 3- Incorrect order of operation
# Organize solution horizontally or vertically to clearly see the sequence.
# Check output from each operation.
# Check different processes available and various possible ways to reach the output.
# Consolidate and simpligy when possible.
toggle_2 = BooleanToggle(True)  # disabled
range_3 = Range(Domain=Domain(0, 1), Steps=panel_148)  # disabled
range_4 = Range(Domain=Domain(0, 1), Steps=panel_147)  # disabled
move_2 = Move(Geometry=circle_10, Motion=Z)  # -> Geometry, Transform; disabled
move_3 = Move(Geometry=circle_11, Motion=Z_2)  # -> Geometry, Transform; disabled
addition_9 = Addition(A=panel_159, B=panel_156)  # disabled

# ---- group: Convert to radians first
rad_3 = Radians(Degrees=panel_164)  # disabled

# ----
Z_3 = UnitZ(Factor=panel_146)  # disabled

# ---- group: Cast to number type
num_23 = Number(panel_149)  # disabled

# ----
num_24 = Number(panel_161)  # disabled
num_25 = Number(panel_162)  # disabled

# ---- group: Check list length
lng = ListLength(List=num_21)  # disabled
lng_2 = ListLength(List=num_19)  # disabled
panel_165 = Panel(lng_2)  # disabled
panel_166 = Panel(lng)  # disabled

# ---- group: Find mid domain
dedomain = DeconstructDomain(Domain=crv_5)  # -> Start, End; disabled
panel_167 = Panel(dedomain.Start)  # disabled
panel_168 = Panel(dedomain.End)  # disabled
expression_6 = Expression(x=panel_167, y=panel_168, Expression="(x+y)/2")  # disabled

# ----
# Key process
# (power)
eval = EvaluateCurve(Curve=crv_4, Parameter=panel_158)  # -> Point, Tangent, Angle; disabled

# ---- group: Reparameterize curve
crv_6 = Curve(reparameterize(crv_5))  # disabled
domain_5 = Domain(crv_6)  # disabled
panel_169 = Panel(domain_5)  # disabled

# ----
# Unclear order of operations
addition_10 = Addition(A=panel_153, B=panel_151)  # disabled

# ---- group: Check data structure
viewer_4 = ParamViewer(num_22)  # disabled
viewer_5 = ParamViewer(num_20)  # disabled

# ---- group: Use appropriate component
eval_2 = EvaluateLength(Curve=crv_5, Length=panel_163, Normalized=toggle_2)  # -> Point, Tangent, Parameter; disabled

# ----
ma = MassAddition(Input=range_3)  # -> Result, PartialResults; disabled
ma_2 = MassAddition(Input=range_4)  # -> Result, PartialResults; disabled
expression_7 = Expression(a=panel_160, b=panel_157, c=panel_154, d=panel_155, Expression="((a+b)*c)%d")  # disabled
expression_8 = Expression(x=panel_161, y=panel_162, Expression="x>y")  # disabled
expression_9 = Expression(x=num_24, y=num_25, Expression="x>y")  # disabled
# Key process
# (Add, Multiply and Remainder)
multiplication_2 = Multiplication(A=addition_10, B=panel_152)  # disabled
# Key process
# (Mass addition)
ma_3 = MassAddition(Input=panel_149)  # -> Result, PartialResults; disabled
panel_170 = Panel(addition_9)  # disabled
panel_171 = Panel("4.2")  # disabled
rotate = Rotate(Geometry=rec, Angle=panel_164, Plane=PlaneXY(0, 0, 0))  # -> Geometry, Transform; disabled

# ---- group: Expensive process
# Patch 60 times
patch = Patch(Curves=graft(move_2.Geometry), Spans=20, Flexibility=1, Trim=True)  # disabled

# ---- group: Less expensive process
# Patch 60 times
boundary_2 = BoundarySurfaces(Edges=move_3.Geometry)  # disabled

# ---- group: Copying is least expensive
move_4 = Move(Geometry=boundary, Motion=Z_3)  # -> Geometry, Transform; disabled

# ----
panel_172 = Panel(eval_2.Point)  # disabled
panel_173 = Panel(ma.Result)  # disabled
panel_174 = Panel(ma_2.Result)  # disabled
mod = Modulus(A=multiplication_2, B=panel_150)  # disabled
addition_11 = Addition(A=num_18, B=num_18)  # disabled
addition_12 = Addition(A=num_21, B=num_19)  # disabled
addition_13 = Addition(A=num_22, B=num_20)  # disabled
# Output
# (Point)
# Wrong output!
panel_175 = Panel(eval.Point)  # disabled
multiplication_3 = Multiplication(A=panel_170, B=panel_171)  # disabled
# Output
# (Sum)
panel_176 = Panel(ma_3.Result)  # disabled
panel_177 = Panel(expression_8)  # disabled
panel_178 = Panel(expression_9)  # disabled

# ---- group: Rotated rectangle
geo_12 = Geometry(rotate.Geometry)  # disabled

# ----
eval_3 = EvaluateCurve(Curve=crv_6, Parameter=panel_163)  # -> Point, Tangent, Angle; disabled
panel_179 = Panel(addition_11)  # disabled
panel_180 = Panel(addition_12)  # disabled
panel_181 = Panel(addition_13)  # disabled
panel_182 = Panel(multiplication_3)  # disabled
panel_183 = Panel("3")  # disabled
# Output
# (Arithmetic result)
panel_184 = Panel(mod)  # disabled
panel_185 = Panel(expression_7)  # disabled
eval_4 = EvaluateCurve(Curve=crv_5, Parameter=expression_6)  # -> Point, Tangent, Angle; disabled
panel_186 = Panel(eval_3.Point)  # disabled
mod_2 = Modulus(A=panel_182, B=panel_183)  # disabled
panel_187 = Panel(eval_4.Point)  # disabled
panel_188 = Panel(mod_2)  # disabled
# Q1: Unioned circles
# Use the 4-step process to design an algorithm that unions 2 circles, given the following: both are located on the XY-Plane. The first circle (Cir1) has a center (C1) = (2,2,2) and radius (R1) = some random number between 3 and 6. The second circle (Cir2) as a center (C2) is shifted to the right of (Cir1) by an amount equal to R1 along positive X-Axis. R2 = R1 * 1.2
panel_189 = Panel("Algorithms Assignment")  # disabled

# ---- group: input numbers
num_26 = Number([3, 24, 13, 55, 66, 21, 12, 6, 9, 14, 98, 8, 66, 43, 61, 62])  # disabled

# Q3: Data operations
# Given the numbers embedded in the Number parameter below:
# 1- Analyze distribution using a graph
# 2- View the data and how it is structured
# 2- Extract even numbers
# 3- Sort numbers descending
# 4- Remap sorted numbers to (100 to 200)
num_27 = Number([3, 24, 13, 55, 66, 21, 12, 6, 9, 14, 98, 8, 66, 43, 61, 62])  # disabled

num_28 = Number([3, 24, 13, 55, 66, 21, 12, 6, 9, 14, 98, 8, 66, 43, 61, 62])  # disabled

num_29 = Number([3, 24, 13, 55, 66, 21, 12, 6, 9, 14, 98, 8, 66, 43, 61, 62])  # disabled

num_30 = Number([3, 24, 13, 55, 66, 21, 12, 6, 9, 14, 98, 8, 66, 43, 61, 62])  # disabled

# ---- group: Input curve reparameterize to 0-1
crv_7 = Curve(reparameterize(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))  # disabled

# ---- group: input list of normalized parameters
panel_190 = Panel("""0
0.2
0.5
0.7
0.8
1""")  # disabled

# ---- group: The components are not ordered from left to right with the flow of the script / Match input (list length > parameter list)
panel_191 = Panel("""1
1.1
0.9
0.9
0.5
0.2
0""")  # disabled

# ---- group: Input plane
xy = XYPlane(Origin=Point(0, 0, 0))  # disabled

# Create input to generate the first circle
# Plane centered at (2,2,2)
xy_2 = XYPlane(Origin=Point(0, 0, 0))  # disabled

# ----
panel_192 = Panel("""1
1.1
0.9
0.9
0.5
0.2
0""")  # disabled

# ---- group: Region union
# Identify key process (curve union operation)
runion = RegionUnion()  # disabled

# ---- group: Input plane
# Identify input needed for the key process (curves and plane - we have the plane)
# Identify input needed for the 2 circles
xy_3 = XYPlane(Origin=Point(0, 0, 0))  # disabled

# ---- group: X
# First analyze the problem and the general flow of the solution
# Input
# Circle 1
panel_193 = Panel("2")  # disabled

# ---- group: Y
panel_194 = Panel("2")  # disabled

# ---- group: Z
# Circle 2
panel_195 = Panel("2")  # disabled

# ---- group: Input plane
# Q2: Sphere with bounds
# Use the 4-step process to draw a sphere with a radius between 2 and 6. If input is less than 2, then set the radius to 2, and if input radius is greater than 6, set the radius to 6. Use a number slider to input the radius and set between 0 and 10 to test.
# Make sure your solution is well organized, color-coded and labeled properly
xy_4 = XYPlane(Origin=Point(0, 0, 0))  # disabled

# ---- group: Union region
# Start with the output (union curve)
crv_8 = Curve()  # disabled

# ---- group: Input plane
xy_5 = XYPlane(Origin=Point(0, 0, 0))  # disabled

xy_6 = XYPlane(Origin=Point(0, 0, 0))  # disabled

# ---- group: Input numbers
panel_196 = Panel(num_26)  # disabled

# ---- group: Input plane
xy_7 = XYPlane(Origin=Point(0, 0, 0))  # disabled

# ---- group: Input numbers
panel_197 = Panel(num_30)  # disabled

# ----
panel_198 = Panel("3 to 6")  # disabled

# ---- group: The components are not ordered from left to right with the flow of the script / Reparameterize the curve if evaluate domain as 0-1
crv_9 = Curve(<curve referenced from the Rhino model>)  # disabled

# ---- group: X
# R2 = R1*1.2
panel_199 = Panel("2")  # disabled

# ---- group: Y
panel_200 = Panel("2")  # disabled

# ---- group: Z
panel_201 = Panel("2")  # disabled

# ---- group: X
# Create input to generate the second circle
# C2 moved along x by R1
panel_202 = Panel("2")  # disabled

# ---- group: Y
panel_203 = Panel("2")  # disabled

# ---- group: Z
panel_204 = Panel("2")  # disabled

# ---- group: X
# Random radius (range =3-6)
panel_205 = Panel("2")  # disabled

# ---- group: Y
panel_206 = Panel("2")  # disabled

# ---- group: Z
panel_207 = Panel("2")  # disabled

# ---- group: X
panel_208 = Panel("2")  # disabled

# ---- group: Y
panel_209 = Panel("2")  # disabled

# ---- group: Z
panel_210 = Panel("2")  # disabled

# ----
# Q4: Pitfalls
# Analyze what the following solution is trying to do, then identify the pitfalls, and rewrite to fix and make easy to read. Properly label and color-code.
crv_10 = Curve(<curve referenced from the Rhino model>)  # disabled

# ---- group: Target domain
panel_211 = Panel("100 To 200")  # disabled

# ---- group: Test if even
panel_212 = Panel("2")  # disabled
mod_3 = Modulus(A=num_30, B=panel_212)  # disabled
panel_213 = Panel("0")  # disabled
equals = Equality(FirstNumber=mod_3, SecondNumber=panel_213)  # -> Equality, Inequality; disabled

# ---- group: Locations on curve
eval_5 = EvaluateCurve(Curve=crv_7, Parameter=panel_190)  # -> Point, Tangent, Angle; disabled

# ----
panel_214 = Panel("3 to 6")  # disabled
panel_215 = Panel("3 to 6")  # disabled

# ---- group: Input radiuses with matching length
panel_216 = Panel("""1
1.1
0.9
0.9
0.5
0.2""")  # disabled

# ---- group: Sort function
sort_2 = SortList(Keys=num_26)  # -> Keys, ValuesA; disabled

# ---- group: Union region
crv_11 = Curve(runion)  # disabled

# ----
# Random distribution between 3 and 98
graph_6 = QuickGraph(num_28, SortOrder=0)  # disabled

# ---- group: First circle plane / C1
pt_16 = ConstructPoint(XCoordinate=panel_199, YCoordinate=panel_200, ZCoordinate=panel_201)  # disabled

pt_17 = ConstructPoint(XCoordinate=panel_202, YCoordinate=panel_203, ZCoordinate=panel_204)  # disabled

# ---- group: Input radius within range
number_slider_9 = Slider(-3.8, range=-5..10)  # disabled

# ---- group: Region union
runion_2 = RegionUnion(Plane=xy_3)  # disabled

# ---- group: First circle plane / C1
pt_18 = ConstructPoint(XCoordinate=panel_205, YCoordinate=panel_206, ZCoordinate=panel_207)  # disabled

# ---- group: Data structure: List of 16 numbers
viewer_6 = ParamViewer(num_29)  # disabled

# ----
panel_217 = Panel(num_29)  # disabled

# ---- group: First circle plane / C1
pt_19 = ConstructPoint(XCoordinate=panel_208, YCoordinate=panel_209, ZCoordinate=panel_210)  # disabled

# ---- group: Input radius within range
# 4- Intermediate input
# and processes
number_slider_10 = Slider(3.9, range=-5..10)  # disabled

# ---- group: First circle plane
pln_4 = Plane(xy_4)  # disabled
pl_origin = PlaneOrigin(Base=pln_4, Origin=pt_16)  # disabled

pln_5 = Plane(xy_5)  # disabled
pl_origin_2 = PlaneOrigin(Base=pln_5, Origin=pt_17)  # disabled

pln_6 = Plane(xy_6)  # disabled
pl_origin_3 = PlaneOrigin(Base=pln_6, Origin=pt_18)  # disabled

# ---- group: Input radius within range
# 3- Input
number_slider_11 = Slider(3.9, range=-5..10)  # disabled

# ---- group: First circle plane
pln_7 = Plane(xy_7)  # disabled
pl_origin_4 = PlaneOrigin(Base=pln_7, Origin=pt_19)  # disabled

# ---- group: The components are not ordered from left to right with the flow of the script / input a list in a panel need to use "multiline data"
panel_218 = Panel("""0
0.2
0.5
0.7
0.8
1""")  # disabled

# ---- group: The components are not ordered from left to right with the flow of the script / Invalid input
eval_6 = EvaluateCurve(Curve=crv_9, Parameter=panel_218)  # -> Point, Tangent, Angle; disabled

# ---- group: Output sphere
# 1- Output
geo_13 = Geometry()  # disabled

# ---- group: First circle
cir1 = Circle(Plane=PlaneXY(0, 0, 0), Radius=1)  # disabled

# ---- group: Create sphere from base plane and radius
# 2- Key Process
sph_7 = Sphere(Base=PlaneXY(0, 0, 0), Radius=1)  # disabled

# ---- group: Second circle
cir2 = Circle(Plane=PlaneXY(0, 0, 0), Radius=1)  # disabled

# ---- group: First circle radius
random = Random(Range=panel_214, Number=1, Seed=2)  # disabled

random_2 = Random(Range=panel_215, Number=1, Seed=2)  # disabled

# ----
panel_219 = Panel("""0
0.2
0.5
0.7
0.8
1""")  # disabled
eval_7 = EvaluateCurve(Curve=crv_10, Parameter=panel_219)  # -> Point, Tangent, Angle; disabled
panel_220 = Panel(random)  # disabled

# ---- group: Radom number generator
random_3 = Random(Range=panel_198, Number=1, Seed=2)  # disabled

# ----
panel_221 = Panel(random_2)  # disabled

# ---- group: Output numbers
panel_222 = Panel(sort_2.Keys)  # disabled

# ---- group: The components are not ordered from left to right with the flow of the script / Wrong component
cir_5 = Circle(Plane=eval_6.Point, Radius=panel_191)  # disabled

# ---- group: Circles normal to curve
circle_12 = CircleCNR(Center=eval_5.Point, Normal=eval_5.Tangent, Radius=panel_216)  # disabled

# ----
cir_6 = Circle(Plane=eval_7.Point, Radius=panel_192)  # disabled

# ---- group: Bounds
panel_223 = Panel("2")  # disabled
panel_224 = Panel("6")  # disabled

panel_225 = Panel("2")  # disabled
panel_226 = Panel("6")  # disabled

panel_228 = Panel("6")  # disabled

# ---- group: Union region
crv_12 = Curve(runion_2)  # disabled

# ----
panel_229 = Panel(random_3)  # disabled

# ---- group: Output from even test
panel_230 = Panel(equals.Equality)  # disabled

# ---- group: Region union
runion_3 = RegionUnion(Curves=[cir1, cir2], Plane=xy_2)  # disabled

# ---- group: Reverse list
rev_2 = ReverseList(List=sort_2.Keys)  # disabled

# ---- group: Input sorted numbers
num_31 = Number(rev_2)  # disabled

# ---- group: Input domain
bnd_4 = Bounds(Numbers=num_31)  # disabled

# ---- group: Check bounds result
panel_231 = Panel(bnd_4)  # disabled

# ---- group: Remap numbers
remap_3 = RemapNumbers(Value=num_31, Source=bnd_4, Target=panel_211)  # -> Mapped, Clipped; disabled

# ---- group: Output remapped numbers
panel_232 = Panel(remap_3.Mapped)  # disabled

# ---- group: Output sphere
geo_14 = Geometry(sph_7)  # disabled

# ---- group: Filter even numbers
dispatch_6 = Dispatch(List=num_30, DispatchPattern=equals.Equality)  # -> ListA, ListB; disabled

# ---- group: The components are not ordered from left to right with the flow of the script / Null input
loft = Loft(Curves=cir_5, Options={Adjust=False, Closed=False, LoftEnds=0, LoftSimp=0, LoftType=0, Rebuild=10, Refit=0.01})  # disabled

# ---- group: Loft surface
loft_2 = Loft(Curves=circle_12, Options={Adjust=False, Closed=False, LoftEnds=0, LoftSimp=0, LoftType=0, Rebuild=10, Refit=0.01})  # disabled

# ----
loft_3 = Loft(Curves=cir_6, Options={Adjust=False, Closed=False, LoftEnds=0, LoftSimp=0, LoftType=0, Rebuild=10, Refit=0.01})  # disabled

# ---- group: move factor
X = UnitX(Factor=random)  # disabled

X_2 = UnitX(Factor=random_2)  # disabled

# ---- group: First circle
cir1_2 = Circle(Plane=pl_origin, Radius=random)  # disabled

cir1_3 = Circle(Plane=pl_origin_2, Radius=random_2)  # disabled

# ---- group: First circle plane
pln_8 = Plane(pl_origin)  # disabled

pln_9 = Plane(pl_origin_2)  # disabled

# ---- group: First circle
cir1_4 = Circle(Plane=pl_origin_3, Radius=random_3)  # disabled

cir1_5 = Circle(Plane=pl_origin_4, Radius=1)  # disabled

# ---- group: Second circle
cir2_2 = Circle(Plane=PlaneXY(0, 0, 0), Radius=1)  # disabled

cir2_3 = Circle(Plane=PlaneXY(0, 0, 0), Radius=1)  # disabled

# ----
panel_233 = Panel("1.2")  # disabled

# ---- group: Construct logic list / Smaller than lower limit
smaller_2 = SmallerThan(FirstNumber=number_slider_9, SecondNumber=panel_223)  # -> SmallerThan, OrEqualTo; disabled

# ---- group: Construct logic list / Larger than upper limit
larger_8 = LargerThan(FirstNumber=number_slider_9, SecondNumber=panel_224)  # -> LargerThan, OrEqualTo; disabled

# ---- group: Output numbers
panel_234 = Panel(rev_2)  # disabled

# ---- group: Output pipe
srf_2 = Surface(loft_2)  # disabled

# ---- group: Union region
crv_13 = Curve(runion_3)  # disabled

# ---- group: Even numbers
panel_235 = Panel(dispatch_6.ListA)  # disabled

# ---- group: Second circle radius
multiplication_4 = Multiplication(A=random, B=panel_233)  # disabled

# ---- group: Second circle plane
move_5 = Move(Geometry=pln_8, Motion=X)  # -> Geometry, Transform; disabled

move_6 = Move(Geometry=pln_9, Motion=X_2)  # -> Geometry, Transform; disabled

# ---- group: Create sphere from base plane and radius
sph_8 = Sphere(Base=PlaneXY(0, 0, 0), Radius=1)  # disabled

# ---- group: Region union
runion_4 = RegionUnion(Curves=[cir1_4, cir2_2], Plane=xy_6)  # disabled

runion_5 = RegionUnion(Curves=[cir1_5, cir2_3], Plane=xy_7)  # disabled

# ---- group: Construct logic list / Within range (neither larger, nor smaller
xnor = GateXnor(A=smaller_2.SmallerThan, B=larger_8.LargerThan)  # disabled

# ---- group: Construct list of radia
panel_236 = Panel([number_slider_10, panel_225, panel_226])  # disabled

# ---- group: Logic list
panel_237 = Panel("")  # disabled

# ---- group: Second circle
cir2_4 = Circle(Plane=move_5.Geometry, Radius=multiplication_4)  # disabled

cir2_5 = Circle(Plane=move_6.Geometry, Radius=1)  # disabled

# ----
# Union
image_3 = ImageSampler(
    FilePath="C:\Users\Rajaa Issa\Desktop\EssentialAlgorithmsAndDataStructures\Images\01_01_Circles.png",
    Filter="Colour",
    Interpolate=False,
    Umax=1,
    Umin=0,
    Vmax=1,
    Vmin=0,
    Wrap=1)  # disabled

# ---- group: Union region
crv_14 = Curve(runion_5)  # disabled

crv_15 = Curve(runion_4)  # disabled

# ---- group: Output sphere
geo_15 = Geometry(sph_8)  # disabled

# ---- group: Construct list of radia
panel_238 = Panel([number_slider_9, panel_223, panel_224])  # disabled

# ---- group: Logic list
panel_239 = Panel([xnor, smaller_2.SmallerThan, larger_8.LargerThan])  # disabled

# ---- group: Filter options
dispatch_7 = Dispatch(List=panel_236, DispatchPattern=panel_237)  # -> ListA, ListB; disabled

# ---- group: Region union
runion_6 = RegionUnion(Curves=[cir1_3, cir2_5], Plane=xy_5)  # disabled

runion_7 = RegionUnion(Curves=[cir1_2, cir2_4], Plane=xy_4)  # disabled

# ---- group: Filter options
dispatch_8 = Dispatch(List=panel_238, DispatchPattern=panel_239)  # -> ListA, ListB; disabled

# ---- group: Create sphere from base plane and radius
sph_9 = Sphere(Base=PlaneXY(0, 0, 0), Radius=dispatch_7.ListA)  # disabled

# ---- group: Union region
crv_16 = Curve(runion_6)  # disabled

crv_17 = Curve(runion_7)  # disabled

# ---- group: Create sphere from base plane and radius
sph_10 = Sphere(Base=PlaneXY(0, 0, 0), Radius=dispatch_8.ListA)  # disabled

# ---- group: Output sphere
geo_16 = Geometry(sph_9)  # disabled

geo_17 = Geometry(sph_10)  # disabled
