# Grasshopper definition TheEssentialMathematics_4thEdition2019.gh (Grasshopper 1.0.7)

Z = Slider(0, range=0..20)  # disabled
X = Slider(4, range=0..20)  # disabled
Y = Slider(3, range=0..20)  # disabled

# ---- group: vector a<a1,a2,a3>
a1 = Slider(2, range=0..10)  # disabled
a2 = Slider(1, range=0..10)  # disabled
a3 = Slider(0, range=0..10)  # disabled

# ---- group: vector b<b1,b2,b3>
b1 = Slider(0, range=0..10)  # disabled
b2 = Slider(2, range=0..10)  # disabled
b3 = Slider(0, range=0..10)  # disabled

# ----
# Point location relative to a surface direction
panel = Panel("Vector Mathematics / Tutorials")  # disabled
# Figure (17) : Find mid point between two input points
t = Slider(1.92, range=-20..20)  # disabled
# The Essential Mathematics for Computational Design, 4th Edition 2019
# Importany note:
# ---------------
# You need to "Enable" each definition before you can view the solutions.
# To enable: select the definition, then click "Enable" under "Solution" menu the "Enable Selected"
panel_2 = Panel("1 Vector Mathematics")
b1_2 = Slider(4, range=0..10)  # disabled
b2_2 = Slider(1, range=0..10)  # disabled
# method 2: Add vectors using the smart addition component in GH
b3_2 = Slider(3, range=0..10)  # disabled
a1_2 = Slider(1, range=0..10)  # disabled
a2_2 = Slider(2, range=0..10)  # disabled
a3_2 = Slider(0, range=0..10)  # disabled
# Figure (9): Adding vectors to find average direction
add_without_unitizing_vectors = Panel("Add vectors")  # disabled
A = Slider(3, range=1..10)  # disabled

# ---- group: distance
A_2 = Slider(1.6, range=0..5)  # disabled

# ----
# method 1: Add vectors by adding their corresponding components
panel_3 = Panel("Figure (8): Adding vectors")  # disabled
panel_4 = Panel("Figure (10): vector subtraction")  # disabled
b1_3 = Slider(4, range=0..10)  # disabled
b2_3 = Slider(1, range=0..10)  # disabled
b3_3 = Slider(4, range=0..10)  # disabled
a1_3 = Slider(1, range=0..10)  # disabled
a2_3 = Slider(2, range=0..10)  # disabled
a3_3 = Slider(0, range=0..10)  # disabled
# method 1: Calculate vector length from vector components
panel_5 = Panel("Figure(5) Vector Length")  # disabled
# Method 1: The dot product of two vectors as a sum of multiplying corresponding components.
# Note that a.b equals b.a
panel_6 = Panel("Dot product")  # disabled
# Method 1: use mathematics: Use determinates to calculate cross product of vectors
vec = VectorXYZ(XComponent=a1, YComponent=a2, ZComponent=a3)  # -> Vector, Length; disabled
# Method 2: use GH component: Use determinates to calculate cross product of vectors
vec_2 = VectorXYZ(XComponent=b1, YComponent=b2, ZComponent=b3)  # -> Vector, Length; disabled

# ---- group: vector b<b1,b2,b3>
b1_4 = Slider(10, range=-10..10)  # disabled
b2_4 = Slider(1, range=-10..10)  # disabled
# Method 2: The dot product of two vectors using the vector dot product component
b3_4 = Slider(0, range=-10..10)  # disabled

# ---- group: point A
# Figure (11): Subtracting vectors to find vector between 2 points
a1_4 = Slider(1, range=0..10)  # disabled
a2_4 = Slider(2, range=0..10)  # disabled
a3_4 = Slider(0, range=0..10)  # disabled
pt = ConstructPoint(XCoordinate=a1_4, YCoordinate=a2_4, ZCoordinate=a3_4)  # disabled

# ---- group: vector a<a1,a2,a3>
a1_5 = Slider(5, range=-10..10)  # disabled
a2_5 = Slider(7, range=-10..10)  # disabled
a3_5 = Slider(0, range=-10..10)  # disabled

a1_6 = Slider(5, range=-10..10)  # disabled
a2_6 = Slider(7, range=-10..10)  # disabled
a3_6 = Slider(0, range=-10..10)  # disabled

# ---- group: vector b<b1,b2,b3>
b1_5 = Slider(10, range=-10..10)  # disabled
b2_5 = Slider(1, range=-10..10)  # disabled
# Figure (12): Positive dot product when the two vectors go in the same direction and negative when they go in the opposite direction
b3_5 = Slider(0, range=-10..10)  # disabled

# ----
# Figure (1): Vector representation in the 3D coordinate system.
step_1 = Panel("Create a vector")
panel_7 = Panel("3")  # disabled
panel_8 = Panel("1")  # disabled
panel_9 = Panel("1")  # disabled

# ---- group: input vectors
# Add unit vectors: Add unit vectors using mass addition component to find average direction
vec_3 = Vector(Vector(0.75, -1.5, 0))  # disabled
vec_4 = Vector(Vector(-0.75, 0.25, 0))  # disabled
vec_5 = Vector(Vector(1.75, 0.5, 0))  # disabled
vec_6 = Vector(Vector(-1, 2, 0))  # disabled

# ---- group: point B
b1_6 = Slider(4, range=0..10)  # disabled
b2_6 = Slider(1, range=0..10)  # disabled
b3_6 = Slider(4, range=0..10)  # disabled
pt_2 = ConstructPoint(XCoordinate=b1_6, YCoordinate=b2_6, ZCoordinate=b3_6)  # disabled

# ---- group: A(33, 38, 0)
pt_3 = Point(Point(33, 38, 0))  # disabled

# ---- group: B(130, 90, 0)
pt_4 = Point(Point(130, 90, 0))  # disabled

# ---- group: C(11, 0, 8)
pt_5 = Point(Point(11, 0, 8))  # disabled

# ---- group: v
num = Number(X)  # disabled
num_2 = Number(Y)  # disabled
# method 2: Use Grasshopper "Unit Vector" component to calculate the unit vector
num_3 = Number(Z)  # disabled

# ----
# Figure (18) : The vector equation of a plane
# n . (r - r0) = 0
panel_10 = Panel("0.5")  # disabled

# ---- group: X
panel_11 = Panel("3")  # disabled

# ---- group: Y
panel_12 = Panel("1")  # disabled

# ---- group: Z
panel_13 = Panel("0")  # disabled

# ----
panel_14 = Panel("Exploded box faces")  # disabled
# Figure (2): Relationship between a vector, vector anchor point and the point coinciding with vector tip location.
step_1_2 = Panel("Create a vector")  # disabled

# ---- group: v
num_4 = Number(X)  # disabled
num_5 = Number(Y)  # disabled
# Figure (7): Vector scalar operation
num_6 = Number(Z)  # disabled

# ---- group: a
# Figure (13) : The dot product of two non-zero unit vectors is equal to the projection length of any one vector onto the unit vector of the other.
vec_7 = Vector(Vector(5, 2, 0))  # disabled

# ---- group: b
# Figure (14) : Calculating the cross product of two vectors
vec_8 = Vector(Vector(9, 0, 0))  # disabled

# ---- group: vector a<a1,a2,a3>
# Given two vectors a and b, they are parallel if, and only if, their cross product equals zero
a1_7 = Slider(2.35, range=0..10)  # disabled
a2_7 = Slider(0, range=0..10)  # disabled
a3_7 = Slider(0, range=0..10)  # disabled

# ---- group: vector b<b1,b2,b3>
b1_7 = Slider(6.5, range=0..10)  # disabled
b2_7 = Slider(0, range=0..10)  # disabled
b3_7 = Slider(0, range=0..10)  # disabled

# ---- group: b
vec_9 = Vector(Vector(10, 20, 0))  # disabled

# ---- group: a
vec_10 = Vector(Vector(30, 10, 0))  # disabled

# ---- group: c
# The dot product of a vector with itself equals the square length of that vector
vec_11 = Vector(Vector(-20, 19, 0))  # disabled

# ---- group: input surface
nurbs = NurbsCurve(Vertices=[Point(4, 0, 0), Point(-1, 6, 0), Point(-1, 15, 0), Point(4, 19, 0)], Degree=3, Periodic=False)  # -> Curve, Length, Domain; disabled
vec_12 = Vector(Vector(0, 0, 7))  # disabled
extr = Extrude(Base=nurbs.Curve, Direction=vec_12)  # disabled

# ---- group: Q
# Figure (16) : The vector equation of a line (P = Q + tv )
pt_6 = Point(Point(3, 8, 0))  # disabled

# ---- group: v
vec_13 = Vector(Vector(6, 2, 0))  # disabled

# ---- group: P0
# Figure (4): A vector define a direction and length. A point defines a location.
pt_7 = Point(Point(0, 0, 0))  # disabled

# ---- group: Q(33, 38, 0)
pt_8 = Point(Point(33, 38, 0))  # disabled

# ---- group: P(130, 90, 0)
pt_9 = Point(Point(130, 90, 0))  # disabled

# ----
panel_15 = Panel("-3, 2.2, 4.1")  # disabled
# Create two tangent spheres between two points
panel_16 = Panel("5.5, 4, -2")  # disabled

# ---- group: anchor point P0
x = Slider(0.8, range=0..10)  # disabled
y = Slider(0.5, range=0..10)  # disabled
# Step 3: Anchor the vector to the point for display
z = Slider(3.2, range=0..10)  # disabled
pt_10 = ConstructPoint(XCoordinate=x, YCoordinate=y, ZCoordinate=z)  # disabled

# ---- group: P0
# Step 4-a: Calculate the end point of the vector by adding corresponding vector parameters.
# rc
num_7 = Number(x)  # disabled
num_8 = Number(y)  # disabled
num_9 = Number(z)  # disabled

# ---- group: vector v
a1_8 = Slider(6, range=0..10)  # disabled
a2_8 = Slider(1.1, range=0..10)  # disabled
# Step 2: Create an anchor point
a3_8 = Slider(2, range=0..10)  # disabled
vec_14 = VectorXYZ(XComponent=a1_8, YComponent=a2_8, ZComponent=a3_8)  # -> Vector, Length; disabled

# ---- group: v
# rs
num_10 = Number(a1_8)  # disabled
num_11 = Number(a2_8)  # disabled
# Step 4-b: Calculate the end point of the vector using GH addition component.
num_12 = Number(a3_8)  # disabled

vec_15 = Vector(vec_14.Vector)  # disabled

num_13 = Number(a1_8)  # disabled
num_14 = Number(a2_8)  # disabled
# method 2: Vector length as an output parameter in the create vector from XYZ component
num_15 = Number(a3_8)  # disabled

vec_16 = Vector(vec_14.Vector)  # disabled

# ---- group: box
box = Box({Plane=PlaneXY(17.81232048, 5.19070049, 0), X=Domain(0, 2.997196299), Y=Domain(0, 2.997196299), Z=Domain(0, 2.992102789)})  # disabled

# ---- group: input parameters
# Step 2: Anchor the vector to one point
a3_9 = Slider(0, range=0..10)
a1_9 = Slider(3.5, range=0..10)
a2_9 = Slider(2.5, range=0..10)

# ---- group: P0
# Figure (3): Position vector. Tip point coordinates equals the corresponding vector components.
pt_11 = Point(pt_10)  # disabled

# ---- group: a<3,4,1>
vec_17 = VectorXYZ(XComponent=panel_7, YComponent=panel_8, ZComponent=panel_9)  # -> Vector, Length; disabled

# ----
t_2 = Slider(0.45, range=0.01..0.99)  # disabled
vec_18 = VectorXYZ(XComponent=num, YComponent=num_2, ZComponent=num_3)  # -> Vector, Length; disabled
panel_17 = Panel(vec_3)  # disabled
panel_18 = Panel(vec_4)  # disabled
panel_19 = Panel(vec_5)  # disabled
panel_20 = Panel(vec_6)  # disabled
A_3 = Anchor(Point(0, 0, 0))  # disabled
A_4 = Anchor(Point(0, 0, 0))  # disabled
vec_19 = VectorXYZ(XComponent=num_4, YComponent=num_5, ZComponent=num_6)  # -> Vector, Length; disabled

# ---- group: v
num_16 = Number(a1_8)  # disabled
num_17 = Number(a2_8)  # disabled
# method 3: Use vector length component
num_18 = Number(a3_8)  # disabled

# Figure(6) Unit vector length equals one unit length of the vector
vec_20 = Vector(vec_14.Vector)  # disabled

# ----
panel_21 = Panel("0,0,0")  # disabled
# Vectors a and b are orthogonal if, and only if, a.b = 0
X_2 = UnitX(Factor=1)  # disabled
Y_2 = UnitY(Factor=1)  # disabled
panel_22 = Panel(vec_15)  # disabled
panel_23 = Panel(pt_7)  # disabled

# ---- group: a
vec_21 = Vector(vec.Vector)  # disabled

# ---- group: b
# Figure (15): Relationship between the angle between vectors and the length of their cross product.
vec_22 = Vector(vec_2.Vector)  # disabled

# ---- group: a
# Give two vectors a and b, their cross product vector c has a length equal to |a|*|b|*sin(angle)
vec_23 = Vector(vec.Vector)  # disabled

# ---- group: b
vec_24 = Vector(vec_2.Vector)  # disabled

# ---- group: a
vec_25 = Vector(vec.Vector)  # disabled

# ---- group: b
vec_26 = Vector(vec_2.Vector)  # disabled

# ---- group: v
vec_27 = Vector(vec_14.Vector)  # disabled

# ---- group: position vector
# method 1: Calculate unit vector by dividing the vector components by the vector length
panel_24 = Panel("0,0,0")  # disabled
vdis = VectorDisplay(Anchor=panel_24, Vector=vec_18.Vector)  # disabled

# ----
panel_25 = Panel(pt_6)  # disabled
panel_26 = Panel(vec_13)  # disabled

# ---- group: r0
vec2pt = Vector2Pt(PointA=pt_3, PointB=pt_5, Unitize=True)  # -> Vector, Length; disabled

# ---- group: P0
pt_12 = Point(pt_10)  # disabled

# ---- group: r
vec2pt_2 = Vector2Pt(PointA=pt_3, PointB=pt_4, Unitize=True)  # -> Vector, Length; disabled

# ----
X_3 = UnitX(Factor=A)  # disabled
vdis_2 = VectorDisplay(Anchor=Point(0, 0, 0), Vector=vec_9)  # disabled
vdis_3 = VectorDisplay(Anchor=Point(0, 0, 0), Vector=vec_10)  # disabled
vdis_4 = VectorDisplay(Anchor=Point(0, 0, 0), Vector=vec_11)  # disabled
expression = Expression(x=num_13, y=num_14, z=num_15, Expression="Sqrt(x^2 + y^2 + z^2)")  # disabled

# ---- group: t*v
multiply = Multiply(Vector=vec_13, Factor=t)  # -> Vector, Length; disabled

# ----
addition = Addition(A=num_7, B=num_10)  # disabled
addition_2 = Addition(A=num_8, B=num_11)  # disabled
addition_3 = Addition(A=num_9, B=num_12)  # disabled

# ---- group: one anchor point
anchorpoints = Point(Point(1, 1, 0))

# ---- group: input point
# GH solution
pt_13 = Point(Point(8, 7, 3))  # disabled

# ---- group: unit(b)
unit = UnitVector(Vector=vec_8)  # disabled

# ---- group: origin point
panel_27 = Panel("0,0,0")  # disabled

# ---- group: a
vec_28 = VectorXYZ(XComponent=a1_3, YComponent=a2_3, ZComponent=a3_3)  # -> Vector, Length; disabled

# ---- group: b
vec_29 = VectorXYZ(XComponent=b1_3, YComponent=b2_3, ZComponent=b3_3)  # -> Vector, Length; disabled

# ----
vdis_5 = VectorDisplay(Anchor=A_3, Vector=vec.Vector)  # disabled
vdis_6 = VectorDisplay(Anchor=A_4, Vector=vec_2.Vector)  # disabled

# ---- group: multiple anchor points
pt_14 = Point([Point(-6, -3, 0), Point(-4, 4, 0), Point(4, 3, 0), Point(1, -2, 0), Point(9, 4, 0)])

# ----
t_3 = Slider(0.33, range=0.01..0.99)  # disabled

# ---- group: a
vec_30 = VectorXYZ(XComponent=a1_2, YComponent=a2_2, ZComponent=a3_2)  # -> Vector, Length; disabled

vec_31 = Vector(vec_30.Vector)  # disabled

# ----
t_4 = Slider(0.33, range=0.01..0.99)  # disabled
t_5 = Slider(0.49, range=0.01..0.99)  # disabled
vdis_7 = VectorDisplay(Anchor=panel_21, Vector=vec_17.Vector)  # disabled

# ---- group: point
pt_15 = ConstructPoint(XCoordinate=panel_11, YCoordinate=panel_12, ZCoordinate=panel_13)  # disabled

# ----
toggle = BooleanToggle(False)  # disabled

# ---- group: b
vec_32 = VectorXYZ(XComponent=b1_2, YComponent=b2_2, ZComponent=b3_2)  # -> Vector, Length; disabled

vec_33 = Vector(vec_32.Vector)  # disabled

# ----
addition_4 = Addition(A=vec_31, B=vec_33)  # disabled

# ---- group: Vector XYZ component
vec_34 = VectorXYZ(XComponent=num_16, YComponent=num_17, ZComponent=num_18)  # -> Vector, Length; disabled

# ---- group: vector
vec_35 = VectorXYZ(XComponent=panel_11, YComponent=panel_12, ZComponent=panel_13)  # -> Vector, Length; disabled

# ---- group: Length
panel_28 = Panel(vec_17.Length)  # disabled

# ----
vdis_8 = VectorDisplay(Anchor=Point(0, 0, 0), Vector=[vec_7, vec_8])  # disabled
expression_2 = Expression(Q=pt_8, P=pt_9, t=panel_10, Expression="Q + t*(P-Q)")  # disabled

# ---- group: Vector length component
vlen = VectorLength(Vector=vec_20)  # disabled

# ---- group: a
vec_36 = VectorXYZ(XComponent=a1_6, YComponent=a2_6, ZComponent=a3_6)  # -> Vector, Length; disabled

# ---- group: b
vec_37 = VectorXYZ(XComponent=b1_5, YComponent=b2_5, ZComponent=b3_5)  # -> Vector, Length; disabled

# ---- group: unit vector addition
unit_2 = UnitVector(Vector=[vec_4, vec_3, vec_5, vec_6])  # disabled
ma = MassAddition(Input=unit_2)  # -> Result, PartialResults; disabled

# ---- group: A
pt_16 = Point(panel_16)  # disabled

# ---- group: B
pt_17 = Point(panel_15)  # disabled

# ---- group: vector length
panel_29 = Panel(vec_19.Length)  # disabled

# ---- group: Display v at P0
dis = VectorDisplay(Anchor=pt_11, Vector=vec_16)  # disabled

# ---- group: tip point P1
addition_5 = Addition(A=vec_16, B=pt_11)  # disabled
pt_18 = Point(addition_5)  # disabled
panel_30 = Panel(pt_18)  # disabled

# ---- group: vector length
panel_31 = Panel(vec_18.Length)  # disabled

# ----
vdis_9 = VectorDisplay(Anchor=Point(0, 0, 0), Vector=vec_19.Vector)  # disabled
vlen_2 = VectorLength(Vector=vec_23)  # disabled
vlen_3 = VectorLength(Vector=vec_24)  # disabled
vlen_4 = VectorLength(Vector=vec_25)  # disabled
rotate = Rotate(Geometry=vec_26, Angle=-0.6283185307, Plane=PlaneXY(0, 0, 0))  # -> Geometry, Transform; disabled
vlen_5 = VectorLength(Vector=vec_26)  # disabled
vdis_10 = VectorDisplay(Anchor=Point(0, 0, 0), Vector=vec_25)  # disabled
dprod = DotProduct(VectorA=X_2, VectorB=Y_2, Unitize=False)  # disabled
vdis_11 = VectorDisplay(Anchor=Point(0, 0, 0), Vector=vec_24)  # disabled
vdis_12 = VectorDisplay(Anchor=Point(0, 0, 0), Vector=vec_23)  # disabled
xprod = CrossProduct(VectorA=vec_21, VectorB=vec_22, Unitize=False)  # -> Vector, Length; disabled

# ---- group: Display v at P0
dis_2 = VectorDisplay(Anchor=pt_12, Vector=vec_27)  # disabled

# ----
panel_32 = Panel("(a2*b3) - (a3*b2) ")  # disabled
panel_33 = Panel("(a3*b1) - (a1*b3)")  # disabled
panel_34 = Panel("(a1*b2) - (a2*b1)")  # disabled

# ---- group: tip point P1
pt_19 = ConstructPoint(XCoordinate=addition, YCoordinate=addition_2, ZCoordinate=addition_3)  # disabled
panel_35 = Panel(pt_19)  # disabled

# ---- group: square length
vlen_6 = VectorLength(Vector=X_3)  # disabled
panel_36 = Panel("2")  # disabled
pow = Power(A=vlen_6, B=panel_36)  # disabled

# ---- group: t
panel_37 = Panel("2.0")  # disabled

# ----
panel_38 = Panel(vec_28.Vector)  # disabled
panel_39 = Panel(vec_29.Vector)  # disabled

# ---- group: v=<a1,a2,a3>
vec_38 = VectorXYZ(XComponent=a1_9, YComponent=a2_9, ZComponent=a3_9)  # -> Vector, Length

# ---- group: v
vec_39 = Vector(vec_38.Vector)

# Step 3: Anchor the vector to multiple points
vec_40 = Vector(vec_38.Vector)

# ----
panel_40 = Panel(addition_4)  # disabled

# ---- group: a
vec_41 = VectorXYZ(XComponent=a1_7, YComponent=a2_7, ZComponent=a3_7)  # -> Vector, Length; disabled

# ---- group: b
vec_42 = VectorXYZ(XComponent=b1_7, YComponent=b2_7, ZComponent=b3_7)  # -> Vector, Length; disabled

# ---- group: same dir vectors
dprod_2 = DotProduct(VectorA=vec_10, VectorB=vec_9, Unitize=True)  # disabled

# ---- group: opposite dir vectors
dprod_3 = DotProduct(VectorA=vec_10, VectorB=vec_11, Unitize=True)  # disabled

# ----
# C#
c_script = CSharpScript(box=box, dis=A_2)  # -> out, A; inputs box: Brep, dis: Double; disabled
# ---------- c_script: C# ----------
    //get the brep center
    Rhino.Geometry.AreaMassProperties area = Rhino.Geometry.AreaMassProperties.Compute(box);
    Point3d box_center = area.Centroid;

    //get a list of faces
    Rhino.Geometry.Collections.BrepFaceList faces = box.Faces;

    //decalre variables
    Point3d center;
    Vector3d dir;
    List<Rhino.Geometry.Brep> exploded_faces = new List<Rhino.Geometry.Brep>();

    //loop through all faces
    for( int i = 0; i < faces.Count(); i++ )
    {
      //extract each of the face
      Rhino.Geometry.Brep extracted_face = box.Faces.ExtractFace(i);

      //get the center of each face
      area = Rhino.Geometry.AreaMassProperties.Compute(extracted_face);
      center = area.Centroid;

      //calculate move direction (from box centroid to face center)
      dir = center - box_center;
      dir.Unitize();
      dir *= dis;

      //move the extracted face
      extracted_face.Transform(Transform.Translation(dir));

      //add to exploded_faces list
      exploded_faces.Add(extracted_face);
    }

    //assign exploded list of faces to output
    A = exploded_faces;
# ---------- end c_script ----------
panel_41 = Panel(vec_32.Vector)  # disabled
# Python
python = PythonScript(box=box, dis=A_2)  # -> out, A; inputs box: Brep; disabled
# ---------- python: Python ----------
import Rhino

#get the brep center
area = Rhino.Geometry.AreaMassProperties.Compute(box)
box_center = area.Centroid

#get a list of faces
faces = box.Faces

#decalre variables
exploded_faces = []

#loop through all faces
for i, face in enumerate(faces):

	#get a duplicate of the face
	extracted_face = faces.ExtractFace(i)
	
	#get the center of each face
	area = Rhino.Geometry.AreaMassProperties.Compute(extracted_face)
	center = area.Centroid
	
	#calculate move direction (from box centroid to face center)
	dir = center - box_center
	dir.Unitize()
	dir *= dis
	
	#move the extracted face
	move = Rhino.Geometry.Transform.Translation(dir)
	extracted_face.Transform(move)
	
	#add to exploded_faces list
	exploded_faces.append(extracted_face)

#assign exploded list of faces to output
A = exploded_faces
# ---------- end python ----------

# ---- group: box center point
# GH solution
boxprop = BoxProperties(Box=box)  # -> Center, Diagonal, Area, Volume, Degeneracy; disabled

# ----
panel_42 = Panel(vec_30.Vector)  # disabled

# ---- group: box faces
debrep = DeconstructBrep(Brep=box)  # -> Faces, Edges, Vertices; disabled

# ----
# VB
vb = VBScript(box=box, dis=A_2)  # -> out, A; inputs box: Brep; disabled
# ---------- vb: VB ----------
    'get the brep center
    Dim area As Rhino.Geometry.AreaMassProperties
    area = Rhino.Geometry.AreaMassProperties.Compute(box)

    Dim box_center As Point3d
    box_center = area.Centroid

    'get a list of faces
    Dim faces As Rhino.Geometry.Collections.BrepFaceList = box.Faces

    'decalre variables
    Dim center As Point3d
    Dim dir As Vector3d
    Dim exploded_faces As New List( Of Rhino.Geometry.Brep )
    Dim i As Int32
    'loop through all faces

    For i = 0 To faces.Count() - 1
      'extract each of the face
      Dim extracted_face As Rhino.Geometry.Brep = box.Faces.ExtractFace(i)

      'get the center of each face
      area = Rhino.Geometry.AreaMassProperties.Compute(extracted_face)
      center = area.Centroid

      'calculate move direction (from box centroid to face center)
      dir = center - box_center
      dir.Unitize()
      dir *= dis

      'move the extracted face
      extracted_face.Transform(Transform.Translation(dir))

      'add to exploded_faces list
      exploded_faces.Add(extracted_face)
    Next

    'assign exploded list of faces to output
    A = exploded_faces
# ---------- end vb ----------
panel_43 = Panel(pt_15)  # disabled

# ---- group: vector length
panel_44 = Panel(vec_34.Length)  # disabled

# ----
toggle_2 = BooleanToggle(False)  # disabled

# ---- group: vector display
dis_3 = VectorDisplay(Anchor=pt_14, Vector=vec_39)

# ---- group: vectors addition
ma_2 = MassAddition(Input=[vec_4, vec_5, vec_6, vec_3])  # -> Result, PartialResults; disabled

# ---- group: vector display
dis_4 = VectorDisplay(Anchor=anchorpoints, Vector=vec_40)

# ----
toggle_3 = BooleanToggle(True)  # disabled

# ---- group: A
pt_20 = Point(panel_16)  # disabled

# ---- group: B
pt_21 = Point(panel_15)  # disabled

# ---- group: Display position vector "v"
dis_5 = VectorDisplay(Anchor=pt_7, Vector=vec_15)  # disabled

# ---- group: tip point P1
addition_6 = Addition(A=vec_15, B=pt_7)  # disabled
pt_22 = Point(addition_6)  # disabled
panel_45 = Panel(pt_22)  # disabled

# ----
A_5 = Anchor(Point(0, 0, 0))  # disabled

# ---- group: B
pt_23 = Point(panel_15)  # disabled

# ---- group: A
pt_24 = Point(panel_16)  # disabled

# ---- group: vector length
panel_46 = Panel(vlen)  # disabled

# ---- group: vector b
vec_43 = Vector(pt)  # disabled

vec_44 = Vector(pt_2)  # disabled

# ---- group: A
pt_25 = Point(panel_16)  # disabled

# ---- group: B
pt_26 = Point(panel_15)  # disabled

# ---- group: Anchor to multiple points
panel_47 = Panel("""0,0,0
-1,1,2
4,1,1
1,1,2""")  # disabled

# ---- group: n
xprod_2 = CrossProduct(VectorA=vec2pt_2.Vector, VectorB=vec2pt.Vector, Unitize=True)  # -> Vector, Length; disabled

# ----
panel_48 = Panel(dprod)  # disabled
vdis_13 = VectorDisplay(Anchor=pt_6, Vector=vec_13)  # disabled

# ---- group: r-r0
subtraction = Subtraction(A=vec2pt_2.Vector, B=vec2pt.Vector)  # disabled

# ---- group: a . b
dprod_4 = DotProduct(VectorA=vec_7, VectorB=unit, Unitize=False)  # disabled
panel_49 = Panel(dprod_4)  # disabled

# ---- group: Q + t*v
addition_7 = Addition(A=pt_6, B=multiply.Vector)  # disabled

# ---- group: unit vector
unit_3 = UnitVector(Vector=vec_19.Vector)  # disabled

# ----
srf_cp = SurfaceClosestPoint(Point=pt_13, Surface=extr)  # -> Point, UVPoint, Distance; disabled

# ---- group: unit vector
division = Division(A=vec_18.Vector, B=vec_18.Length)  # disabled
panel_50 = Panel(division)  # disabled
vlen_7 = VectorLength(Vector=division)  # disabled
panel_51 = Panel(vlen_7)  # disabled

# ----
panel_52 = Panel("La*Lb*sin(angle)")  # disabled

# ---- group: angle between a and b
angle = Angle(VectorA=vec_23, VectorB=vec_24)  # -> Angle, Reflex; disabled

# ----
panel_53 = Panel("La*Lb*sin(angle)")  # disabled

# ---- group: angle between a and b
angle_2 = Angle(VectorA=vec_25, VectorB=rotate.Geometry)  # -> Angle, Reflex; disabled

# ----
# Python with RhinoCommon Only
python_2 = PythonScript(pt=pt_13, srf=extr)  # -> out, A; inputs pt: Point3d, srf: Surface; disabled
# ---------- python_2: Python ----------
#find the closest point
found, u, v = srf.ClosestPoint(pt)

if found:

    #get closest point
    closest_pt = srf.PointAt(u, v)
    
    #calculate direction from closest point to test point
    dir = pt - closest_pt
    
    #calculate surface normal
    normal = srf.NormalAt(u, v)
    
    #compare the two directions using the dot product
    A = dir * normal
# ---------- end python_2 ----------

# ---- group: t*a
multiplication = Multiplication(A=vec_17.Vector, B=panel_37)  # disabled

# ----
# Pythong with RhinoScriptSyntax
python_3 = PythonScript(pt=pt_13, srf=extr)  # -> out, A; disabled
# ---------- python_3: Python ----------
#import RhinoScript library
import rhinoscriptsyntax as rs

#find the closest point
u, v = rs.SurfaceClosestPoint(srf, pt)

#get closest point
closest_pt = rs.EvaluateSurface(srf, u, v)

#calculate direction from closest point to test point
dir = rs.PointCoordinates(pt) - closest_pt

#calculate surface normal
normal = rs.SurfaceNormal(srf, [u, v])

#compare the two directions using the dot product
A = dir * normal
# ---------- end python_3 ----------
# VB
vb_2 = VBScript(pt=pt_13, srf=extr)  # -> out, A; inputs pt: Point3d, srf: Surface; disabled
# ---------- vb_2: VB ----------
    'Decalre variables
    Dim u, v As Double
    Dim closest_pt As Point3d

    'get closest point u, v
    srf.ClosestPoint(pt, u, v)

    'get closest point
    closest_pt = srf.PointAt(u, v)

    'calculate direction from closest point to test point
    Dim dir As New Vector3d(pt - closest_pt)

    'calculate surface normal
    Dim normal = srf.NormalAt(u, v)

    'compare the two directions using the dot product
    A = dir * normal
# ---------- end vb_2 ----------

# ---- group: position vector of unit vector
panel_54 = Panel("0,0,0")  # disabled
vdis_14 = VectorDisplay(Anchor=panel_54, Vector=division)  # disabled

# ----
panel_55 = Panel(xprod.Vector)  # disabled
panel_56 = Panel(xprod.Length)  # disabled

# ---- group: dot product of a.b = real number
expression_3 = Expression(a1=a1_5, a2=a2_5, a3=a3_5, b1=b1_4, b2=b2_4, b3=b3_4, Expression="(a1*b1) + (a2*b2) + (a3*b3)")  # disabled

# ---- group: dot product of b.a = real number
expression_4 = Expression(a1=a1_5, a2=a2_5, a3=a3_5, b1=b1_4, b2=b2_4, b3=b3_4, Expression="(b1*a1) + (b2*a2) + (b3*a3)")  # disabled

# ----
# C#
c_script_2 = CSharpScript(pt=pt_13, srf=extr)  # -> out, A; inputs pt: Point3d, srf: Surface; disabled
# ---------- c_script_2: C# ----------
    //Decalre variables
    double u, v;
    Point3d closest_pt;

    //get closest point u, v
    srf.ClosestPoint(pt, out u, out v);

    //get closest point
    closest_pt = srf.PointAt(u, v);

    //calculate direction from closest point to test point
    Vector3d dir = pt - closest_pt;

    //calculate surface normal
    Vector3d normal = srf.NormalAt(u, v);

    //compare the two directions using the dot product
    A = dir * normal;
# ---------- end c_script_2 ----------
panel_57 = Panel(vlen_6)  # disabled

# ---- group: dot product
dprod_5 = DotProduct(VectorA=X_3, VectorB=X_3, Unitize=toggle)  # disabled

# ----
vdis_15 = VectorDisplay(Anchor=A_5, Vector=xprod.Vector)  # disabled

# ---- group: D
expression_5 = Expression(A=pt_16, B=pt_17, t=t_2, Expression="A + t*(B-A)")  # disabled

# ---- group: Add corresponding components of 2 vectors
addition_8 = Addition(A=a2_2, B=b2_2)  # disabled
addition_9 = Addition(A=a1_2, B=b1_2)  # disabled
addition_10 = Addition(A=a3_2, B=b3_2)  # disabled

# ----
panel_58 = Panel("0,0,0")  # disabled
panel_59 = Panel(dprod_3)  # disabled
panel_60 = Panel(dprod_2)  # disabled
panel_61 = Panel(ma.Result)  # disabled

# ---- group: C=centroid of faces
amoments = AreaMoments(Geometry=debrep.Faces)  # -> Area, Centroid, Inertia, InertiaError, Secondary, SecondaryError, Gyration; disabled

# ---- group: exploded faces
viewer = ParamViewer(c_script.A)  # disabled

# ----
# Python
python_4 = PythonScript(A=pt_25, B=pt_26, t=t_5)  # -> out, S1, S2; inputs A: Point3d, B: Point3d; disabled
# ---------- python_4: Python ----------
import Rhino

#find a point between A and B
D = A + t * (B - A)

#find mid point between A and D
C1 = A + 0.5 * (D - A)

#find mid point between D and B
C2 = D + 0.5 * (B - D)

#find spheres radius
r1 = A.DistanceTo(C1)
r2 = B.DistanceTo(C2)

#create spheres and assign to output
S1 = Rhino.Geometry.Sphere(C1, r1)
S2 = Rhino.Geometry.Sphere(C2, r2)
# ---------- end python_4 ----------
panel_62 = Panel(ma_2.Result)  # disabled

# ---- group: exploded faces
viewer_2 = ParamViewer(python.A)  # disabled

# ----
panel_63 = Panel(expression_2)  # disabled

# ---- group: exploded faces
viewer_3 = ParamViewer(vb.A)  # disabled

# ---- group: display b vector
panel_64 = Panel(vec_43)  # disabled
dis_6 = VectorDisplay(Anchor=panel_27, Vector=vec_43)  # disabled

# ---- group: display a vector
panel_65 = Panel(vec_44)  # disabled
dis_7 = VectorDisplay(Anchor=panel_27, Vector=vec_44)  # disabled

# ----
# VB
vb_3 = VBScript(A=pt_20, B=pt_23, t=t_3)  # -> out, S1, S2; inputs A: Point3d, B: Point3d; disabled
# ---------- vb_3: VB ----------
    'declare variables
    Dim D, C1, C2 As Rhino.Geometry.Point3d
    Dim r1, r2 As Double

    'find a point between A and B
    D = A + t * (B - A)

    'find mid point between A and D
    C1 = A + 0.5 * (D - A)
    
    'find mid point between D and B
    C2 = D + 0.5 * (B - D)
    
    'find spheres radius
    r1 = A.DistanceTo(C1)
    r2 = B.DistanceTo(C2)

    'create spheres and assign to output
    S1 = New Rhino.Geometry.Sphere(C1, r1)
    S2 = New Rhino.Geometry.Sphere(C2, r2)
# ---------- end vb_3 ----------
# C#
c_script_3 = CSharpScript(A=pt_24, B=pt_21, t=t_4)  # -> out, S1, S2; inputs A: Point3d, B: Point3d, t: Double; disabled
# ---------- c_script_3: C# ----------
    //declare variables
    Rhino.Geometry.Point3d D, C1, C2;
    double r1, r2;

    //find a point between A and B
    D = A + t * (B - A);

    //find mid point between A and D
    C1 = A + 0.5 * (D - A);

    //find mid point between D and B
    C2 = D + 0.5 * (B - D);

    //find spheres radius
    r1 = A.DistanceTo(C1);
    r2 = B.DistanceTo(C2);

    //create spheres and assign to output
    S1 = new Rhino.Geometry.Sphere(C1, r1);
    S2 = new Rhino.Geometry.Sphere(C2, r2);
# ---------- end c_script_3 ----------

# ---- group: Cross product of parallel vectors
xprod_3 = CrossProduct(VectorA=vec_41.Vector, VectorB=vec_42.Vector, Unitize=False)  # -> Vector, Length; disabled

# ---- group: unit vector length = 1
vlen_8 = VectorLength(Vector=unit_3)  # disabled
panel_66 = Panel(vlen_8)  # disabled

# ---- group: M
pt_27 = Point(expression_2)  # disabled

# ---- group: dot product of vectors
dprod_6 = DotProduct(VectorA=vec_36.Vector, VectorB=vec_37.Vector, Unitize=toggle_2)  # disabled

# ----
panel_67 = Panel(unit_3)  # disabled
P = Point(addition_7)  # disabled

# ---- group: dot product of unitized vectors
dprod_7 = DotProduct(VectorA=vec_36.Vector, VectorB=vec_37.Vector, Unitize=toggle_3)  # disabled

# ----
eval = Evaluate(F=panel_32, a2=a2, a3=a3, b2=b2, b3=b3)  # disabled
eval_2 = Evaluate(F=panel_33, a1=a1, a3=a3, b1=b1, b3=b3)  # disabled
eval_3 = Evaluate(F=panel_34, a1=a1, a2=a2, b1=b1, b2=b2)  # disabled

# ---- group: vector length
panel_68 = Panel(expression)  # disabled

# ---- group: a-b
subtraction_2 = Subtraction(A=vec_43, B=vec_44)  # disabled

# ----
vdis_16 = VectorDisplay(Anchor=Point(0, 0, 0), Vector=unit_3)  # disabled
dprod_8 = DotProduct(VectorA=xprod_2.Vector, VectorB=subtraction, Unitize=False)  # disabled
vdis_17 = VectorDisplay(Anchor=panel_58, Vector=multiplication)  # disabled
vlen_9 = VectorLength(Vector=multiplication)  # disabled

# ---- group: b-a
# b - a
subtraction_3 = Subtraction(A=vec_29.Vector, B=vec_28.Vector)  # disabled

# ---- group: a-b
# a - b
subtraction_4 = Subtraction(A=vec_28.Vector, B=vec_29.Vector)  # disabled

# ---- group: Display vector
dis_8 = VectorDisplay(Anchor=panel_47, Vector=vec_35.Vector)  # disabled

# ---- group: 2*a=<2*3, 2*4, 2*1>
panel_69 = Panel(multiplication)  # disabled

# ----
panel_70 = Panel(pow)  # disabled
panel_71 = Panel(dprod_5)  # disabled

# ---- group: point behind surface
panel_72 = Panel(c_script_2.A)  # disabled

panel_73 = Panel(vb_2.A)  # disabled

# ---- group: vector from surface to point
vec2pt_3 = Vector2Pt(PointA=srf_cp.Point, PointB=pt_13, Unitize=False)  # -> Vector, Length; disabled

# ---- group: face normal
evalsrf = EvaluateSurface(Surface=extr, Point=srf_cp.UVPoint)  # -> Point, Normal, UDirection, VDirection, Frame; disabled

# ---- group: point behind surface
panel_74 = Panel(python_2.A)  # disabled

# ---- group: c = a + b
vec_45 = VectorXYZ(XComponent=addition_9, YComponent=addition_8, ZComponent=addition_10)  # -> Vector, Length; disabled

# ---- group: origin
panel_75 = Panel("0,0,0")  # disabled

# ---- group: point behind surface
panel_76 = Panel(python_3.A)  # disabled

# ---- group: origin
panel_77 = Panel("0,0,0")  # disabled

# ----
panel_78 = Panel(P)  # disabled

# ---- group: move direction of faces
vec2pt_4 = Vector2Pt(PointA=boxprop.Center, PointB=amoments.Centroid, Unitize=False)  # -> Vector, Length; disabled

# ----
panel_79 = Panel(python_4.S1)  # disabled
panel_80 = Panel(python_4.S2)  # disabled

# ---- group: projection_vector
amp = Amplitude(Vector=unit, Amplitude=panel_49)  # disabled

# ----
panel_81 = Panel(vb_3.S2)  # disabled
panel_82 = Panel(c_script_3.S1)  # disabled
panel_83 = Panel(c_script_3.S2)  # disabled

# ---- group: cross product
xprod_4 = CrossProduct(VectorA=vec_23, VectorB=vec_24, Unitize=False)  # -> Vector, Length; disabled

xprod_5 = CrossProduct(VectorA=vec_25, VectorB=rotate.Geometry, Unitize=False)  # -> Vector, Length; disabled

# ----
panel_84 = Panel(vb_3.S1)  # disabled

# ---- group: |a|*|b|*sin(angle)
eval_4 = Evaluate(F=panel_52, La=vlen_2, Lb=vlen_3, angle=angle.Angle)  # disabled

eval_5 = Evaluate(F=panel_53, La=vlen_4, Lb=vlen_5, angle=angle_2.Angle)  # disabled

# ----
panel_85 = Panel(eval_2)  # disabled
panel_86 = Panel(eval_3)  # disabled
panel_87 = Panel(eval)  # disabled
panel_88 = Panel(dprod_6)  # disabled

# ---- group: 2*Length
panel_89 = Panel(vlen_9)  # disabled

# ----
panel_90 = Panel(dprod_7)  # disabled
panel_91 = Panel(xprod_3.Vector)  # disabled
panel_92 = Panel(xprod_3.Length)  # disabled
panel_93 = Panel(dprod_8)  # disabled
panel_94 = Panel(subtraction_3)  # disabled
panel_95 = Panel(subtraction_4)  # disabled

# ---- group: display a-b
panel_96 = Panel("0,0,0")  # disabled
dis_9 = VectorDisplay(Anchor=panel_96, Vector=subtraction_4)  # disabled

# ---- group: display b-a
panel_97 = Panel("0,0,0")  # disabled
dis_10 = VectorDisplay(Anchor=panel_97, Vector=subtraction_3)  # disabled

# ---- group: display a-b vector
panel_98 = Panel(subtraction_2)  # disabled
dis_11 = VectorDisplay(Anchor=pt_2, Vector=subtraction_2)  # disabled

# ---- group: display a & b
panel_99 = Panel("0,0,0")  # disabled
dis_12 = VectorDisplay(Anchor=panel_99, Vector=[vec_28.Vector, vec_29.Vector])  # disabled

# ----
amp_2 = Amplitude(Vector=vec2pt_4.Vector, Amplitude=A_2)  # disabled
panel_100 = Panel(vec_45.Vector)  # disabled

# ---- group: C1
expression_6 = Expression(A=pt_16, D=expression_5, t=t_2, Expression="A + 0.5*(D-A)")  # disabled

# ---- group: C2
expression_7 = Expression(D=expression_5, B=pt_17, t=t_2, Expression="D + 0.5*(B-D)")  # disabled

# ---- group: display a
panel_101 = Panel("0")  # disabled
panel_102 = Panel("0")  # disabled
panel_103 = Panel("0")  # disabled
pt_28 = ConstructPoint(XCoordinate=panel_101, YCoordinate=panel_102, ZCoordinate=panel_103)  # disabled
dis_13 = VectorDisplay(Anchor=pt_28, Vector=vec_30.Vector)  # disabled

# ---- group: dot product
dprod_9 = DotProduct(VectorA=vec2pt_3.Vector, VectorB=evalsrf.Normal, Unitize=False)  # disabled

# ---- group: cross product vector
vec_46 = VectorXYZ(XComponent=eval, YComponent=eval_2, ZComponent=eval_3)  # -> Vector, Length; disabled

# ----
vdis_18 = VectorDisplay(Anchor=Point(0, 0, 0), Vector=amp)  # disabled

# ---- group: display b
pt_29 = ConstructPoint(XCoordinate=a1_2, YCoordinate=a2_2, ZCoordinate=a3_2)  # disabled
dis_14 = VectorDisplay(Anchor=pt_29, Vector=vec_32.Vector)  # disabled

# ---- group: display vectors
dis_15 = VectorDisplay(Anchor=panel_75, Vector=ma.Result)  # disabled
dis_16 = VectorDisplay(Anchor=panel_75, Vector=unit_2)  # disabled

dis_17 = VectorDisplay(Anchor=panel_77, Vector=ma_2.Result)  # disabled
dis_18 = VectorDisplay(Anchor=panel_77, Vector=[vec_4, vec_5, vec_6, vec_3])  # disabled

# ----
panel_104 = Panel(xprod_4.Vector)  # disabled
panel_105 = Panel(xprod_5.Vector)  # disabled

# ---- group: Display vectors and their unit vectors
panel_106 = Panel("0,0,0")  # disabled
vdis_19 = VectorDisplay(Anchor=panel_106, Vector=[vec_36.Vector, vec_37.Vector])  # disabled
vdis_20 = VectorDisplay(Anchor=panel_106, Vector=unitize([vec_36.Vector, vec_37.Vector]))  # disabled

# ----
vdis_21 = VectorDisplay(Anchor=Point(0, 0, 0), Vector=xprod_4.Vector)  # disabled

# ---- group: cross vector length
panel_107 = Panel(xprod_4.Length)  # disabled

# ----
panel_108 = Panel(eval_4)  # disabled
vdis_22 = VectorDisplay(Anchor=Point(0, 0, 0), Vector=xprod_5.Vector)  # disabled

# ---- group: cross vector length
panel_109 = Panel(xprod_5.Length)  # disabled

# ----
panel_110 = Panel(eval_5)  # disabled
A_6 = Anchor(Point(0, 0, 0))  # disabled

# ---- group: display dir
vdis_23 = VectorDisplay(Anchor=amoments.Centroid, Vector=vec2pt_4.Vector)  # disabled

# ---- group: point dir
vdis_24 = VectorDisplay(Anchor=srf_cp.Point, Vector=vec2pt_3.Vector)  # disabled

# ----
panel_111 = Panel(expression_3)  # disabled
panel_112 = Panel(expression_4)  # disabled

# ---- group: move faces
move = Move(Geometry=debrep.Faces, Motion=amp_2)  # -> Geometry, Transform; disabled

# ---- group: point behind surface
panel_113 = Panel(dprod_9)  # disabled

# ----
vdis_25 = VectorDisplay(Anchor=A_6, Vector=vec_46.Vector)  # disabled

# ---- group: display vectors
panel_114 = Panel("0,0,0")  # disabled
vec_47 = VectorXYZ(XComponent=b1_4, YComponent=b2_4, ZComponent=b3_4)  # -> Vector, Length; disabled
vec_48 = VectorXYZ(XComponent=a1_5, YComponent=a2_5, ZComponent=a3_5)  # -> Vector, Length; disabled
vdis_26 = VectorDisplay(Anchor=panel_114, Vector=[vec_48.Vector, vec_47.Vector])  # disabled

# ---- group: face dir
vdis_27 = VectorDisplay(Anchor=srf_cp.Point, Vector=evalsrf.Normal)  # disabled

# ---- group: r1
dist = Distance(PointA=pt_16, PointB=expression_6)  # disabled

# ---- group: r2
dist_2 = Distance(PointA=expression_7, PointB=pt_17)  # disabled

# ----
pl = PlaneNormal(Origin=[expression_6, expression_7], ZAxis=Vector(0, 0, 1))  # disabled

# ---- group: display c (a+b)
dis_19 = VectorDisplay(Anchor=pt_28, Vector=vec_45.Vector)  # disabled

# ----
sph = Sphere(Base=pl, Radius=[dist, dist_2])  # disabled
panel_115 = Panel("1")  # disabled

# ---- group: Random transformation!
panel_116 = Panel("16")  # disabled
panel_117 = Panel("5")  # disabled
random = Random(Range=Domain(0, 1), Number=panel_116, Seed=panel_117)  # disabled

# ----
mbox = MeshBox(
    Base={Plane=PlaneXY(-5.819077969, 1, 1.973939538), X=Domain(0, 2), Y=Domain(0, 2), Z=Domain(0, 2.000000119)},
    XCount=panel_115,
    YCount=panel_115,
    ZCount=panel_115)  # disabled
# Can construct any size matrix using Matric component.
# For example, we can represent a point in a amtrix format using [3x1] matrix
panel_118 = Panel("2 Transformations")
# Projection to XY-Plane
# Sets the "z" value of all points to "0"
panel_119 = Panel("Figure (24): Projection transformation")  # disabled
A_7 = Slider(30, range=-180..180)  # disabled

# ---- group: matrix dimention [rows, cols]
# It is possible to create custom transformation matrix by filling the [4x4] values with any numbers. Result might not be predictable.
panel_120 = Panel("4")  # disabled
panel_121 = Panel("4")  # disabled

# ---- group: translation vector
# Figure (19): Translate or move geometry
# Move component generates a transformation matrix that is used to translate geometry. It has consistant general form based on the translation vector
panel_122 = Panel("4")  # disabled
panel_123 = Panel("5")  # disabled
# Figure (20): Rotation around z-axis
# Rotate component generates a transformation matrix that is used to roate geometry. It has consistent general form based on the rotation angle
panel_124 = Panel("3")  # disabled
vec_49 = VectorXYZ(XComponent=panel_122, YComponent=panel_123, ZComponent=panel_124)  # -> Vector, Length; disabled

# ---- group: Default matrix (no values) = identity matrix
panel_125 = Panel("4")  # disabled
panel_126 = Panel("4")  # disabled
matrix = ConstructMatrix(Rows=panel_125, Columns=panel_126)  # disabled

# ---- group: keep Y coordinate fixed
zy = Slider(0, range=-5..5)  # disabled
xy = Slider(0, range=-5..5)  # disabled

# ----
number_slider = Slider(1.29, range=0..5)  # disabled

# ---- group: keep X coordinate fixed
yx = Slider(0, range=-5..5)  # disabled
zx = Slider(0, range=-5..5)  # disabled

# ---- group: keep Z coordinate fixed
# Figure (23): Mirror or reflection transformation matrix
yz = Slider(-0.62, range=-5..5)  # disabled
xz = Slider(2.56, range=-5..5)  # disabled

# ----
# Figure (22): Shear Matrix
# Shear transformation matrix might not be very intuitive to control. The script alows control per axis
number_slider_2 = Slider(2.33, range=0..5)  # disabled
number_slider_3 = Slider(4.77, range=0..5)  # disabled
# Projection to XZ-Plane
# Sets the "y" value of all points to "0"
nurbs_2 = NurbsCurve(Vertices=[Point(0, 0, 0), Point(6, 0, 4), Point(7, 5, 1), Point(4, 8, 4), Point(0, 10, 4)], Degree=3, Periodic=False)  # -> Curve, Length, Domain; disabled
# Projection to YZ-Plane
# Sets the "x" value of all points to "0"
nurbs_3 = NurbsCurve(Vertices=[Point(0, 0, 0), Point(6, 0, 4), Point(7, 5, 1), Point(4, 8, 4), Point(0, 10, 4)], Degree=3, Periodic=False)  # -> Curve, Length, Domain; disabled
xz_2 = XZPlane(Origin=Point(0, 0, 0))  # disabled
nurbs_4 = NurbsCurve(Vertices=[Point(0, 0, 0), Point(6, 0, 4), Point(7, 5, 1), Point(4, 8, 4), Point(0, 10, 4)], Degree=3, Periodic=False)  # -> Curve, Length, Domain; disabled
xy_2 = XYPlane(Origin=Point(0, 0, 0))  # disabled
# Tutorial
# Use one matrix to transform geometry as follows:
# First, move input geometry so that it's center is at the origin, then rotate 45 degrees around the z axis, then scale uniformly by 0.2, then move back to original location.
# 
# Performance note:
# With big number of points to transform, it is faster to create one master transformation matrix (multiply all matrices first), then apply once to all points, as opposed to transforming points multiple times with one matrix at a time
yz_2 = YZPlane(Origin=Point(0, 0, 0))  # disabled
number_slider_4 = Slider(0.25, range=0..5)  # disabled

# ---- group: rotate around z-axis
panel_127 = Panel("0,0,0")  # disabled
# Figure (21): Scale geometry
# Scale component generates a transformation matrix that is used to scale geometry. It has consistent general form based on the scale factors in x, y and z direction
Z_2 = UnitZ(Factor=1)  # disabled
line = LineSDL(Start=panel_127, Direction=Z_2, Length=1)  # disabled

# ---- group: Input geometry
box_2 = Box([{Plane=PlaneXY(9, 6, 0), X=Domain(0, 6), Y=Domain(0, 8), Z=Domain(0, 2)}, {Plane=PlaneXY(14, 12, 0), X=Domain(0, 4), Y=Domain(0, 8), Z=Domain(0, 2)}, {Plane=PlaneXY(0, 18, 0), X=Domain(0, 7), Y=Domain(0, 2), Z=Domain(0, 2)}])  # disabled

# ---- group: Mirror across xy plane
xy_3 = XYPlane(Origin=Point(0, 0, 0))  # disabled
mirror = Mirror(Geometry=mbox, Plane=xy_3)  # -> Geometry, Transform; disabled

# ---- group: Mirror across xz plane
xz_3 = XZPlane(Origin=Point(0, 0, 0))  # disabled
mirror_2 = Mirror(Geometry=mbox, Plane=xz_3)  # -> Geometry, Transform; disabled

# ---- group: Mirror across yz plane
yz_3 = YZPlane(Origin=Point(0, 0, 0))  # disabled
mirror_3 = Mirror(Geometry=mbox, Plane=yz_3)  # -> Geometry, Transform; disabled

# ---- group: Mirror across custom plane
pl_3pt = Plane3Pt(
    PointA=Point(-7.996120516, 2.068148347, 2.460360264),
    PointB=Point(-2.357964791, 2.068148347, 4.512481124),
    PointC=Point(-7.642035209, 5.931851653, 1.487518876))  # disabled
mirror_4 = Mirror(Plane=pl_3pt)  # -> Geometry, Transform; disabled

# ---- group: #rows
panel_128 = Panel("3")  # disabled

# ---- group: #columns
panel_129 = Panel("1")  # disabled

# ---- group: x
panel_130 = Panel("2.1")  # disabled

# ---- group: y
panel_131 = Panel("3.6")  # disabled

# ---- group: z
# Transformation matrix size is [4x4].
# The default matrix is called "identity matrix", and when used to transform geomtry, it stays in place.
panel_132 = Panel("4.2")  # disabled

# ----
box_3 = Box({Plane=PlaneXY(-4.52518602, 1.363296127, 0), X=Domain(0, 2.087421943), Y=Domain(0, 3.498041177), Z=Domain(0, 1.542736569)})  # disabled

# ---- group: input geometry
box_4 = Box({Plane=PlaneXY(0, 4, 0), X=Domain(0, 2), Y=Domain(0, 2), Z=Domain(0, 2)})  # disabled

# ----
project = Project(Geometry=nurbs_2.Curve, Plane=xz_2)  # -> Geometry, Transform; disabled

# ---- group: input geometry
box_5 = Box({Plane=PlaneXY(0, 0, 0), X=Domain(0, 2), Y=Domain(0, 2), Z=Domain(0, 2)})  # disabled

# ----
project_2 = Project(Geometry=nurbs_3.Curve, Plane=yz_2)  # -> Geometry, Transform; disabled

# ---- group: Input point
pt_30 = Point(Point(2, 3, 0))  # disabled

# ---- group: Angle
A_8 = Number(expr("Rad(x)", A_7))  # disabled

# ----
project_3 = Project(Geometry=nurbs_4.Curve, Plane=xy_2)  # -> Geometry, Transform; disabled

# ---- group: construct matrix
matrix_2 = ConstructMatrix(Rows=panel_120, Columns=panel_121, Values=random)  # disabled

# ---- group: Input point
pt_31 = Point(Point(2, 3, 0))  # disabled

# ---- group: Input geometry
rec = Rectangle({Plane=PlaneXY(7, 7, 0), Size=Domain2(u=-3..3, v=-4..4)})  # disabled

# ---- group: input geometry
box_6 = Box({Plane=PlaneXY(6, 0, 0), X=Domain(0, 2), Y=Domain(0, 2), Z=Domain(0, 2)})  # disabled

# ----
bbox = BoundingBox(Content=box_2, Plane=PlaneXY(0, 0, 0), UnionBox=True)  # -> Box, Box_2; disabled
crv = Curve(project_2.Geometry)  # disabled
scale = Scale(Geometry=box_4, Center=Point(0, 0, 0), Factor=number_slider_4)  # -> Geometry, Transform; disabled
crv_2 = Curve(project.Geometry)  # disabled
scale_nu = ScaleNU(Plane=PlaneXY(0, 0, 0), ScaleX=number_slider, ScaleY=number_slider_3, ScaleZ=number_slider_2)  # -> Geometry, Transform; disabled
crv_3 = Curve(project_3.Geometry)  # disabled

# ---- group: Scale factor
panel_133 = Panel("0.2")  # disabled

# ---- group: Rotation angle in radian
panel_134 = Panel("0.25*Pi")  # disabled

# ---- group: Extract center
area = Area(Geometry=bbox.Box)  # -> Area, Centroid; disabled

# ---- group: GH Move component
move_2 = Move(Geometry=box_5, Motion=vec_49.Vector)  # -> Geometry, Transform; disabled

# ---- group: origin
panel_135 = Panel("0,0,0")  # disabled

# ----
vb_4 = VBScript(G=box_3, m01=xy, m21=zy, m10=yx, m20=zx, m02=xz, m12=yz)  # -> out, A, M; inputs G: Brep; disabled
# ---------- vb_4: VB ----------
    'Declare and instantiate a matrix type
    Dim matrix As New Rhino.Geometry.Transform(1)
    
    'Set matrix values to the input
    matrix(0, 1) = m01
    matrix(2, 1) = m21
    matrix(1, 0) = m10
    matrix(2, 0) = m20
    matrix(0, 2) = m02
    matrix(1, 2) = m12

    'Transform input geometry using the matrix
    G.Transform(matrix)

    'Print transformation matrix
    Dim xform_string As String
    Dim i As Int32
    Dim j As Int32
    Dim num_str As String
    Dim num As Double
    For i = 0 To 3
      xform_string = ""
      For j = 0 To 3
        num = matrix(i, j)
        num_str = String.Format("{0:n2}", num)

        xform_string = xform_string + " " + num_str
      Next
      Print(xform_string)
    Next

    'Assign output
    A = G
    M = matrix
# ---------- end vb_4 ----------
rotax = RotateAxis(Geometry=box_6, Angle=A_8, Axis=line)  # -> Geometry, Transform; disabled

# ---- group: construct the matrix
matrix_3 = ConstructMatrix(Rows=panel_128, Columns=panel_129, Values=[panel_130, panel_131, panel_132])  # disabled

# ----
matrix_4 = DisplayMatrix(mirror.Transform)  # disabled
matrix_5 = DisplayMatrix(mirror_2.Transform)  # disabled
matrix_6 = DisplayMatrix(mirror_3.Transform)  # disabled
matrix_7 = DisplayMatrix(mirror_4.Transform)  # disabled

# ---- group: Identity matric values
matrix_8 = DisplayMatrix(matrix, Digits=2)  # disabled

# ----
transform = Transform(Geometry=pt_30, Transform=matrix)  # disabled

# ---- group: Input does not change when transformed using identity matrix
panel_136 = Panel(pt_30)  # disabled
panel_137 = Panel(transform)  # disabled

# ----
matrix_9 = DisplayMatrix(matrix_2, Digits=2)  # disabled

# ---- group: Matrix dot product
transform_2 = Transform(Geometry=pt_31, Transform=matrix_2)  # disabled

# ---- group: Multiplication performs Dot Product
multiplication_2 = Multiplication(A=pt_31, B=matrix_2)  # disabled

# ----
panel_138 = Panel(pt_31)  # disabled

# ---- group: Transform geometry (dot product all 4 rectangle points)
transform_3 = Transform(Geometry=rec, Transform=matrix_2)  # disabled

# ----
matrix_10 = DisplayMatrix(project_3.Transform)  # disabled
matrix_11 = DisplayMatrix(project.Transform)  # disabled
matrix_12 = DisplayMatrix(project_2.Transform)  # disabled

# ---- group: Move to origin
vec2pt_5 = Vector2Pt(PointA=area.Centroid, PointB=panel_135, Unitize=False)  # -> Vector, Length; disabled

# ----
panel_139 = Panel("0.25*Pi")  # disabled

# ---- group: non uniform scale
# Non-uniform scale
# -----------------------
# scale_x  0     0     0
#  0   scale_y   0     0
#  0     0   scale_z   0
#  0     0      0      1
matrix_13 = DisplayMatrix(scale_nu.Transform)  # disabled

# ---- group: uniform scale
matrix_14 = DisplayMatrix(scale.Transform, Digits=2)  # disabled

# ---- group: translation amtrix
matrix_15 = DisplayMatrix(move_2.Transform, Digits=1)  # disabled

# ---- group: rotation around z
matrix_16 = DisplayMatrix(rotax.Transform, Digits=2)  # disabled

# ---- group: sin(A)
sin = Sine(Value=A_8)  # disabled
# Uniform scale
# -----------------------
# scale  0     0     0
#  0   scale   0     0
#  0     0   scale   0
#  0     0     0     1
panel_140 = Panel(sin)  # disabled

# ---- group: cos(A)
cos = Cosine(Value=A_8)  # disabled
# Rotation by z-axis by A
# -----------------------
# cos(A) -sin(A)   0    0
# sin(A)  cos(A)   0    0
#    0      0      1    0
#    0      0      0    1
panel_141 = Panel(cos)  # disabled

# ----
matrix_17 = DisplayMatrix(vb_4.M)  # disabled
brep = Brep(vb_4.A)  # disabled
panel_142 = Panel("0.2")  # disabled

# ---- group: (x,y,z)
matrix_18 = DisplayMatrix(matrix_3, Digits=1)  # disabled

# ---- group: Tutorial solution using Python scripting
python_5 = GhPythonScript(geom=box_2, angle=panel_134, scale=panel_133)  # -> out, A, M; inputs geom: list of GeometryBase; disabled
# ---------- python_5: Python ----------
__author__ = "RajaaIssa"
__version__ = "2019.05.30"

import Rhino

#Move to origin, find center
center = Rhino.Geometry.Point3d.Unset
if geom.Count > 0:
    bbox = geom[0].GetBoundingBox(True)
    for i in range(1, geom.Count):
        bbox.Union(geom[i].GetBoundingBox(True))
    center = bbox.Center

origin = Rhino.Geometry.Point3d.Origin
#Create move transformation matrix
m1 = Rhino.Geometry.Transform.Translation(origin - center)
#Create rotation transformation matrix
m2 = Rhino.Geometry.Transform.Rotation(angle, origin)
#Create scale transformation matrix
m3 = Rhino.Geometry.Transform.Scale(origin, scale)
#Create move back transformation matrix
m4 = Rhino.Geometry.Transform.Identity
result, m4 = m1.TryGetInverse()

#Multiply from last to first transformation
matrix = m4 * m3 * m2 * m1

#Apply transformation to all input geometry
for g in geom:
    g.Transform(matrix)

#Assign output
M = matrix
A = geom
# ---------- end python_5 ----------

# ---- group: Tutorial solution using VB scripting
vb_5 = VBScript(geom=box_2, angle=panel_134, scale=panel_133)  # -> out, A, M; inputs geom: list of GeometryBase; disabled
# ---------- vb_5: VB usings ----------
Imports System.IO
Imports System.Linq
Imports System.Data
Imports System.Drawing
Imports System.Reflection
Imports System.Windows.Forms
Imports System.Xml
Imports System.Xml.Linq
Imports Microsoft.VisualBasic
Imports System.Runtime.InteropServices

Imports Rhino.DocObjects
Imports Rhino.Collections
Imports GH_IO
Imports GH_IO.Serialization
# ---------- vb_5: VB ----------
    Dim center As Point3d = Point3d.Unset

    If geom.Count > 0 Then
      Dim bbox As BoundingBox = geom(0).GetBoundingBox(True)

      For i As Integer = 1 To geom.Count - 1
        bbox.Union(geom(i).GetBoundingBox(True))
      Next

      center = bbox.Center
    Else
      Return
    End If

    Dim m1 = Rhino.Geometry.Transform.Translation(Point3d.Origin - center)
    Dim m2 = Rhino.Geometry.Transform.Rotation(angle, Point3d.Origin)
    Dim m3 = Rhino.Geometry.Transform.Scale(Point3d.Origin, scale)
    Dim m4 = Rhino.Geometry.Transform.Identity
    m1.TryGetInverse(m4)
    Dim matrix = m4 * m3 * m2 * m1

    For i As Integer = 0 To geom.Count - 1
      geom(i).Transform(matrix)
    Next

    M = matrix
    A = geom
# ---------- end vb_5 ----------

# ---- group: Tutorial solution using C# scripting
c_script_4 = CSharpScript(geom=box_2, angle=panel_134, scale=panel_133)  # -> out, A, M; inputs geom: list of GeometryBase, angle: Double, scale: Double; disabled
# ---------- c_script_4: C# ----------
    //Move to origin, find center
    Point3d center = Point3d.Unset;
    if(geom.Count > 0)
    {
      BoundingBox bbox = geom[0].GetBoundingBox(true);
      for(int i = 1; i < geom.Count ; i++)
      {
        bbox.Union(geom[i].GetBoundingBox(true));
      }
      center = bbox.Center;
    }
    else
      return;

    //Create move transformation matrix
    var m1 = Rhino.Geometry.Transform.Translation(Point3d.Origin - center);
    //Create rotation transformation matrix
    var m2 = Rhino.Geometry.Transform.Rotation(angle, Point3d.Origin);
    //Create scale transformation matrix
    var m3 = Rhino.Geometry.Transform.Scale(Point3d.Origin, scale);
    //Create move back transformation matrix
    var m4 = Rhino.Geometry.Transform.Identity;
    m1.TryGetInverse(out m4);

    //Multiply from last to first transformation
    var matrix = m4 * m3 * m2 * m1;

    //Apply transformation to all input geometry
    for(int i = 0; i < geom.Count ; i++)
    {
      geom[i].Transform(matrix);
    }

    //Assign output
    M = matrix;
    A = geom;
# ---------- end c_script_4 ----------

# ---- group: Transformed geometry
panel_143 = Panel(transform_2)  # disabled
panel_144 = Panel(multiplication_2)  # disabled

# ---- group: Move to origin
move_3 = Move(Motion=vec2pt_5.Vector)  # -> Geometry, Transform; disabled

# ----
rotate_2 = Rotate(Angle=panel_139, Plane=PlaneXY(0, 0, 0))  # -> Geometry, Transform; disabled
scale_2 = Scale(Center=Point(0, 0, 0), Factor=panel_142)  # -> Geometry, Transform; disabled
inverse = InverseTransform(Transform=move_3.Transform)  # disabled

# ---- group: Use script to multiply matreces
c_script_5 = CSharpScript(m1=move_3.Transform, m2=rotate_2.Transform, m3=scale_2.Transform, m4=inverse)  # -> out, A; inputs m1: Transform, m2: Transform, m3: Transform, m4: Transform; disabled
# ---------- c_script_5: C# ----------
    //Final multiplication matrix = multiplying last to first transformation
    var matrix = m4 * m3 * m2 * m1;

    //Alternative solution use "*" for the matrix dot product
    //var matrix = Rhino.Geometry.Transform.Multiply(m4, m3);
    //matrix = Rhino.Geometry.Transform.Multiply(matrix, m2);
    //matrix = Rhino.Geometry.Transform.Multiply(matrix, m1);
    
    //Assign output
    A = matrix;
# ---------- end c_script_5 ----------

# ---- group: Transform with master matrix
transform_4 = Transform(Geometry=box_2, Transform=c_script_5.A)  # disabled

# ---- group: Master matrix with all 4 transformation
matrix_19 = DisplayMatrix(python_5.M)  # disabled

matrix_20 = DisplayMatrix(c_script_4.M)  # disabled

# ---- group: General form of the move (translation)
panel_145 = Panel("""Move
-----------------------
1     0    0    x
0     1    0    y
0     0    1    z
0     0    0    1""")  # disabled

# ---- group: General form of mirror across xy-plane
panel_146 = Panel("""Mirror across xy-plane
-----------------------
1     0    0    0
0     1    0    0
0     0   -1    0
0     0    0    1""")  # disabled

# ---- group: General form of mirror across xz-plane
panel_147 = Panel("""Mirror across xz-plane
-----------------------
1     0    0    0
0    -1    0    0
0     0    1    0
0     0    0    1""")  # disabled

# ---- group: General form of mirror across yz-plane
panel_148 = Panel("""Mirror across yz-plane
-----------------------
-1    0    0    0
0     1    0    0
0     0    1    0
0     0    0    1""")  # disabled

# ---- group: General form of projection to xy-plane
panel_149 = Panel("""Project xy-plane
-----------------------
1     0    0    0
0     1    0    0
0     0    0    0
0     0    0    1""")  # disabled

# ---- group: General form of projection to xz-plane
panel_150 = Panel("""Project xz-plane
-----------------------
1     0    0    0
0     0    0    0
0     0    1    0
0     0    0    1""")  # disabled

# ---- group: General form of projection to yz-plane
panel_151 = Panel("""Project yz-plane
-----------------------
0     0    0    0
0     1    0    0
0     0    1    0
0     0    0    1""")  # disabled

# ---- group: Move matrix
matrix_21 = DisplayMatrix(move_3.Transform)  # disabled

# ---- group: Rotate 45
matrix_22 = DisplayMatrix(rotate_2.Transform)  # disabled

# ---- group: Scale 0.2
matrix_23 = DisplayMatrix(scale_2.Transform)  # disabled

# ---- group: Move back (inverse move matrix)
matrix_24 = DisplayMatrix(inverse)  # disabled

# ---- group: Master matrix with all 4 transformation
matrix_25 = DisplayMatrix(c_script_5.A)  # disabled

matrix_26 = DisplayMatrix(vb_5.M)  # disabled

# ----
nurbs_5 = NurbsCurve(
    Vertices=[Point(-4689.076001, -2040.478225, 0), Point(-4583.540454, -1983.340886, 0), Point(-4494.207506, -1896.276528, 0), Point(-4734.117807, -1515.176639, 0), Point(-4616.533541, -1482.684562, 0), Point(-4497, -1472, 0)],
    Degree=3,
    Periodic=False)  # -> Curve, Length, Domain; disabled
nurbs_6 = NurbsCurve(
    Vertices=[Point(-4497, -1472, 0), Point(-3960, -1424, 0), Point(-3844, -1946, 0), Point(-3964, -2098.714286, 0)],
    Degree=3,
    Periodic=False)  # -> Curve, Length, Domain; disabled
number_slider_5 = Slider(3, range=0..10)  # disabled

# ---- group: Interpolate points
# Figure (42) Non-uniform knot list can help produce smoother curves. The curve on the left interpolate through points with non-uniform knots, and produces smoother curvature. The curve on the right interpolate through the same points but forces a uniform spacing of knots, resulting curve is not as smooth.
pt_32 = Point([Point(6.555946771, 39.89407191, 0), Point(9.888710029, 42.60965679, 0), Point(29.63841822, 37.67222974, 0), Point(33.34148851, 40.38781462, 0), Point(34.9461523, 38.78315083, 0)])  # disabled

# ---- group: Degree
panel_152 = Panel("3")  # disabled

# ---- group: Chord & Sqrt Chord option create non-uniform curve with smoother curvature
# Figure (43) A NURBS approximation of a circle is rational and non-uniform NURBS.
list = ValueList({"Uniform": 0, "Chord": 1, "Sqrt Chord": 2}, selected="Chord")  # disabled
# ----
# 3 Parametric Curves and Surfaces
panel_153 = Panel("Figure (25): Curve domain")  # disabled
panel_154 = Panel("Figure (26): Curve domain")  # disabled
# Parametric Curves and Surfaces Tutorials
panel_155 = Panel("Mark singular points")  # disabled
range = Range(Domain=Domain(0, 1), Steps=5)  # disabled

# ---- group: constuct a NURBS surface
panel_156 = Panel("Pi to 2*Pi")  # disabled
# Figure (56): The surface parameter rectangle with domain spanning from u0 to u1 in the first direction and v0 to v1 in the second direction.
xz_4 = XZPlane(Origin=Point(0, 0, 0))  # disabled
panel_157 = Panel("10")  # disabled
panel_158 = Panel("20")  # disabled
arc = Arc(Plane=xz_4, Radius=panel_157, Angle=panel_156)  # -> Arc, Length; disabled
Y_3 = UnitY(Factor=panel_158)  # disabled
extr_2 = Extrude(Base=arc.Arc, Direction=Y_3)  # disabled

# ----
crv_4 = Curve(reparameterize(nurbs_5.Curve))  # disabled
crv_5 = Curve(reparameterize(nurbs_6.Curve))  # disabled
t_6 = Slider(0, range=0..1)  # disabled
number_slider_6 = Slider(130, range=0..1000)  # disabled
# Figure (52): Examining curve curvature at different points
# 
# Curvature is defined as the change in inclination of a tangent to a curve over unit length of arc. For a circle or sphere, it is constant and is equal to the reciprocal of the radius
panel_159 = Panel("12")  # disabled
panel_160 = Panel("6")  # disabled

# ---- group: input surface
# Figure (57): Evaluate a NURBS surface
srf = Surface(extr_2)  # disabled

# ---- group: Examine a parametric degree NURBS curve
number_slider_7 = Slider(2, range=1..5)  # disabled
toggle_4 = BooleanToggle(True)  # disabled
pt_33 = Point([Point(36, 0, 0), Point(48, 0, 0), Point(48, 12, 0), Point(36, 12, 0)])  # disabled
nurbs_7 = NurbsCurve(Vertices=pt_33, Degree=number_slider_7, Periodic=toggle_4)  # -> Curve, Length, Domain; disabled

# ----
panel_162 = Panel("5")  # disabled

# ---- group: input surface
# Evaluate outside the domain of a NURBS surface
srf_2 = Surface(extr_2)  # disabled

# Evaluate mid domain of a NURBS surface
srf_3 = Surface(extr_2)  # disabled

# Evaluate all (u,v) valuse of a NURBS surface within its domain
srf_4 = Surface(extr_2)  # disabled

# Figure (58): Tangent and normal vectors to a surface.
srf_5 = Surface(extr_2)  # disabled

# ---- group: evaluate at equal intervals of parameters
# Figure (29): Equal parameter intervals in a degree-1 line evaluate to equal curve lengths.
# Figure (30): Equal parameter intervals do not usually translate into equal distances on a curve.
panel_163 = Panel("5")  # disabled
range_2 = Range(Domain=Domain(0, 1), Steps=panel_163)  # disabled

# ----
# Figure (51): Examining curve continuity with curvature graph analysis.
nurbs_8 = NurbsCurve(
    Vertices=[Point(17.75043752, 36.26166285, 0), Point(20.6485601, 32.85398024, 0), Point(20.77595011, 18.52260481, 0), Point(4.91589463, 15.97480474, 0)],
    Degree=3,
    Periodic=False)  # -> Curve, Length, Domain; disabled

# ---- group: examine free form curve
crv_6 = Curve(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)  # disabled

# ---- group: srf1
# Figure (59): Examining surface continuity
# G0 continuity of NURBS surfaces
srf_6 = Surface(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)  # disabled

# ---- group: srf2
srf_7 = Surface(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)  # disabled

srf_8 = Surface(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)  # disabled

# ---- group: srf3
srf_9 = Surface(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)  # disabled

# ---- group: surface
# Figure (61): Principle curvatures at a surface point are the minimum and maximum curvatures at that point.
# in a cylindrical surface, min curvature = 0 (in the linear dir) and max curvature = 1/radius.
xz_5 = XZPlane(Origin=Point(0, 0, 0))  # disabled
panel_164 = Panel("10")  # disabled
panel_165 = Panel("20")  # disabled
arc_2 = Arc(Plane=xz_5, Radius=panel_164, Angle=Domain(0, 3.141592654))  # -> Arc, Length; disabled
Y_4 = UnitY(Factor=panel_165)  # disabled
extr_3 = Extrude(Base=arc_2.Arc, Direction=Y_4)  # disabled

# ----
# Figure (27): Reset curve domain
nurbs_9 = NurbsCurve(
    Vertices=[Point(0, 3, 0), Point(1, 5, 0), Point(3, 5, 0), Point(5, 0, 0), Point(8, 3, 0), Point(10, 1, 0)],
    Degree=3,
    Periodic=False)  # -> Curve, Length, Domain; disabled

# ---- group: evaluate at equal intervals of parameters
# Figure (31): Tangent at curve parameter
panel_166 = Panel("5")  # disabled
range_3 = Range(Domain=Domain(0, 1), Steps=panel_166)  # disabled

# ----
nurbs_10 = NurbsCurve(
    Vertices=[Point(34.72515553, 16.30237903, 0), Point(38.54685564, 21.16594739, 0), Point(34.85254553, 37.79034289, 0), Point(17.75043752, 36.26166285, 0)],
    Degree=3,
    Periodic=False)  # -> Curve, Length, Domain; disabled

# ---- group: parameter
panel_167 = Panel("0.3")  # disabled

# ---- group: srf1
srf_10 = Surface(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)  # disabled

# ---- group: srf2
srf_11 = Surface(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)  # disabled

srf_12 = Surface(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)  # disabled

# ---- group: srf3
srf_13 = Surface(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)  # disabled

# ---- group: srf1
# G2 continuity of NURBS surfaces
srf_14 = Surface(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)  # disabled

# ---- group: srf2
srf_15 = Surface(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)  # disabled

srf_16 = Surface(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)  # disabled

# ----
number_slider_8 = Slider(130, range=0..1000)  # disabled

# ---- group: srf3
srf_17 = Surface(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)  # disabled

# ----
number_slider_9 = Slider(130, range=0..1000)
panel_168 = Panel("1")  # disabled
panel_169 = Panel("1.5")  # disabled
# Calculate continuity between curves assuming the first curve end meets the second curve at start
panel_170 = Panel("2")  # disabled

# ---- group: input linear curve
line_2 = Line(Line((2, 3, 0), (13, 6, 0)))  # disabled

# ---- group: min domain
panel_171 = Panel("2.5")  # disabled

# ---- group: max domain
# Figure (28): Normalize curve domain to be 0 to 1
panel_172 = Panel("32.5")  # disabled

# ----
panel_173 = Panel("1")  # disabled
panel_174 = Panel("1.5")  # disabled
panel_175 = Panel("2")  # disabled
nurbs_11 = NurbsCurve(
    Vertices=[Point(110.3934794, 32.66655175, 0), Point(106.9018621, 32.35445188, 0), Point(103.4671838, 31.40534676, 0), Point(110.4750492, 20.27328328, 0), Point(107.8656019, 17.73010237, 0), Point(104.782871, 16.06110034, 0)],
    Degree=5,
    Periodic=False)  # -> Curve, Length, Domain; disabled
nurbs_12 = NurbsCurve(
    Vertices=[Point(125.9625992, 14.36000428, 0), Point(129.4678419, 18.82084295, 0), Point(126.0794406, 34.06864884, 0), Point(110.3934794, 32.66655175, 0)],
    Degree=3,
    Periodic=False)  # -> Curve, Length, Domain; disabled
range_4 = Range(Domain=Domain(0, 1), Steps=20)  # disabled
domain² = Domain²(srf_3)  # disabled
panel_176 = Panel("1")  # disabled
panel_177 = Panel("1.5")  # disabled
panel_178 = Panel("2")  # disabled
nurbs_13 = NurbsCurve(
    Vertices=[Point(70.97637196, 34.2310668, 0), Point(65.48019131, 33.73978809, 0), Point(70.5299014, 21.17499685, 0), Point(65.67735183, 18.5478084, 0)],
    Degree=3,
    Periodic=False)  # -> Curve, Length, Domain
nurbs_14 = NurbsCurve(
    Vertices=[Point(85.68085202, 16.94118365, 0), Point(88.99142915, 21.15428716, 0), Point(85.79120459, 35.55529765, 0), Point(70.97637196, 34.2310668, 0)],
    Degree=3,
    Periodic=False)  # -> Curve, Length, Domain

# ---- group: input curve
crv_7 = Curve(nurbs_9.Curve)  # disabled

# ---- group: parameter (0-1)
number_slider_10 = Slider(0.65, range=0..1)  # disabled

# Figure (32): Cubic polynomial curves
number_slider_11 = Slider(0.722, range=0..1)  # disabled

# ---- group: Non-uniform interpolate curve
intcrv = Interpolate(Vertices=pt_32, Degree=panel_152, Periodic=False, KnotStyle=list)  # -> Curve, Length, Domain; disabled

# ----
cir = Circle(Plane=PlaneXY(0, 0, 0), Radius=panel_162)  # disabled
ellipse = Ellipse(Plane=PlaneXY(0, 0, 0), Radius1=panel_159, Radius2=number_slider_5)  # -> Ellipse, Focus1, Focus2; disabled
panel_179 = Panel("6")  # disabled
number_slider_12 = Slider(0.596, range=0..1)  # disabled
number_slider_13 = Slider(0.596, range=0..1)  # disabled

# ---- group: examine a circle
cir_2 = Circle(Plane=PlaneXY(20, 44, 0), Radius=number_slider_5)  # disabled

# ---- group: create NURBS curve
# Figure (45, 47): Analyze degree-3 and degree-2 open non-rational NURBS curve.
# Figure (46, 48): Analyze degree-3 and degree-2 closed non-rational NURBS curve.
number_slider_14 = Slider(2, range=1..5)  # disabled
toggle_5 = BooleanToggle(False)  # disabled
pt_34 = Point([Point(0, 0, 0), Point(10, 0, 0), Point(10, 10, 0), Point(0, 10, 0)])  # disabled
nurbs_15 = NurbsCurve(Vertices=pt_34, Degree=number_slider_14, Periodic=toggle_5)  # -> Curve, Length, Domain; disabled

# ----
number_slider_15 = Slider(0.596, range=0..1)  # disabled
number_slider_16 = Slider(0.596, range=0..1)  # disabled
number_slider_17 = Slider(0.596, range=0..1)  # disabled
number_slider_18 = Slider(0.596, range=0..1)  # disabled

# ---- group: P0
pt_35 = Point(Point(0, 0, 0))  # disabled

# ---- group: P1
pt_36 = Point(Point(4, 17, 0))  # disabled

# ---- group: P2
pt_37 = Point(Point(21, 13, 0))  # disabled

# ---- group: P3
# Figure (35): Evaluate points on a Bezier curve using De Casteljau algorithm
pt_38 = Point(Point(20, -3, 0))  # disabled

# ----
number_slider_19 = Slider(0.531, range=0..1)  # disabled
number_slider_20 = Slider(0.286, range=0..1)  # disabled
number_slider_21 = Slider(0.5, range=0..1)  # disabled
number_slider_22 = Slider(0.525, range=0..1)  # disabled
domain²_2 = Domain²(srf_2)  # disabled

# ---- group: open curve
nurbs_16 = NurbsCurve(
    Vertices=[Point(4.348688295, 4.033554257, 0), Point(2.620135624, 12.52817264, 0), Point(12.64109144, 10.83600997, 0), Point(17.79789119, 4.43446545, 0), Point(22.51013924, 11.28056167, 0), Point(42.70398051, 13.70386872, 0), Point(42.48667007, 4.142209475, 0)],
    Degree=3,
    Periodic=False)  # -> Curve, Length, Domain; disabled

# ---- group: parameter within domain (0-1)
number_slider_23 = Slider(0.5, range=0..1)  # disabled

# ---- group: input curve reparameterized (domain set to 0 to 1)
crv_8 = Curve(reparameterize(nurbs_9.Curve))  # disabled

# ----
# Figure (41) Uniform knot list means that spacing between knots is constant, with the exception of clamped curves where they can full multiplicity knot at start and end, and still be considered uniform. The left curve is periodic (closed without kink), and the right is clamped (open).
crv_9 = Curve(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)  # disabled

# ---- group: (A): Open or clamped curve
# Figure (40) (A): Clamped curves have fully-multiple knots at their start and end that is equal to the curve degree (3 in this case). The rest of the knots are simple. (B): A fully multiple knot in the middle creates a kink and the curve is forced to go through the associated control point.
# Full multiplicity knots at start
# Full multiplicity knots in the middle
nurbs_17 = NurbsCurve(
    Vertices=[Point(4.348688295, 4.033554257, 0), Point(2.620135624, 12.52817264, 0), Point(12.64109144, 10.83600997, 0), Point(17.79789119, 4.43446545, 0), Point(22.51013924, 11.28056167, 0), Point(42.70398051, 13.70386872, 0), Point(42.48667007, 4.142209475, 0)],
    Degree=3,
    Periodic=False)  # -> Curve, Length, Domain; disabled

# ---- group: closed curve
# Figure (37): The effect of varying weights of control points on the result curve.
nurbs_18 = NurbsCurve(Vertices=[Point(0, 0, 0), Point(0, 4, 0), Point(2, 5, 0), Point(4, 4, 0), Point(4, 0, 0)], Degree=3, Periodic=False)  # -> Curve, Length, Domain; disabled

# ---- group: circle with radius=2
# Figure (38-39): There are degree-1 more knots than control points. If the number of control points=7, and curve degree=3, then number of knots is 9. Knots values are parameters that evaluate to points on the 3D curve. Scaling the knot list does not change the 3D curve.
cir_3 = Circle(Plane=PlaneXY(9, 2, 0), Radius=2)  # disabled

# ---- group: deconstruct domain
dedom2 = DeconstructDomain²(Domain=srf)  # -> UComponent, VComponent; disabled

# ---- group: deconstruct the domain
dedom2num = DeconstructDomain²(Domain=domain²)  # -> UMin, UMax, VMin, VMax; disabled

# ---- group: input curve reparameterized
crv_10 = Curve(reparameterize(nurbs_9.Curve))  # disabled

# ---- group: Parameters (equal spacing)
range_5 = Range(Domain=Domain(0, 1), Steps=panel_179)  # disabled

# ----
srf_18 = Surface(extr_3)  # disabled
sph_2 = Sphere(Base=PlaneXY(0, 0, 0), Radius=panel_168)  # disabled
cone = Cone(Base=PlaneXY(0, 0, 0), Radius=panel_169, Length=panel_170)  # -> Cone, Tip; disabled
crv_11 = Curve(nurbs_8.Curve)  # disabled
crv_12 = Curve(nurbs_10.Curve)  # disabled
panel_180 = Panel("0 to 100")  # disabled
sph_3 = Sphere(Base=PlaneXY(0, 0, 0), Radius=panel_173)  # disabled
cone_2 = Cone(Base=PlaneXY(0, 0, 0), Radius=panel_174, Length=panel_175)  # -> Cone, Tip; disabled

# ---- group: Input curves
# Figure (44): Evaluate parameters to points on 3D curve. Minimum and maximum parameters (t0 and t1) evaluate to the start and end points of the 3D curve
crv_13 = Curve(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)  # disabled

# ----
# G1 continuity of NURBS surfaces
panel_181 = Panel("1")  # disabled
sph_4 = Sphere(Base=PlaneXY(0, 0, 0), Radius=panel_176)  # disabled
cone_3 = Cone(Base=PlaneXY(0, 0, 0), Radius=panel_177, Length=panel_178)  # -> Cone, Tip; disabled
srf_19 = Surface(extr_3)  # disabled
srf_20 = Surface(extr_3)  # disabled
panel_182 = Panel("1")  # disabled

# ---- group: evaluate a curve at t
eval_6 = EvaluateCurve(Curve=line_2, Parameter=panel_167)  # -> Point, Tangent, Angle; disabled

# ----
crv_14 = Curve(nurbs_13.Curve)  # disabled

# ---- group: curve domain
domain = Domain(crv_7)  # disabled

# ----
crv_15 = Curve(nurbs_14.Curve)  # disabled
crv_16 = Curve(nurbs_11.Curve)  # disabled
crv_17 = Curve(nurbs_12.Curve)  # disabled
panel_183 = Panel("0 to 4")  # disabled
dedom2_2 = DeconstructDomain²(Domain=srf_7)  # -> UComponent, VComponent; disabled
dedom2_3 = DeconstructDomain²(Domain=srf_8)  # -> UComponent, VComponent; disabled
panel_184 = Panel("1")  # disabled
panel_185 = Panel("1")  # disabled

# ---- group: script to reset curve domain
vb_6 = VBScript(crv=crv_7, x=panel_171, y=panel_172)  # -> out, A; inputs crv: Curve; disabled
# ---------- vb_6: VB ----------
    'Create custom domain
    Dim dom As Interval
    dom.T0 = x
    dom.T1 = y

    'Assign the new domain to the curve
    crv.Domain = dom

    'Assign the new curve to output
    A = crv
# ---------- end vb_6 ----------

# ----
panel_186 = Panel("1")  # disabled
panel_187 = Panel("1")  # disabled
dedom2_4 = DeconstructDomain²(Domain=srf_11)  # -> UComponent, VComponent; disabled
dedom2_5 = DeconstructDomain²(Domain=srf_12)  # -> UComponent, VComponent; disabled
dedom2_6 = DeconstructDomain²(Domain=srf_15)  # -> UComponent, VComponent; disabled
dedom2_7 = DeconstructDomain²(Domain=srf_16)  # -> UComponent, VComponent; disabled

# ---- group: deconstruct the domain
dedom2num_2 = DeconstructDomain²(Domain=domain²_2)  # -> UMin, UMax, VMin, VMax; disabled

# ---- group: C
c_24_14_0 = Point(Point(24, 14, 0))  # disabled

# ---- group: D
d_28_4_0 = Point(Point(28, -4, 0))  # disabled

# ---- group: A
a_7_4_0 = Point(Point(-7, -4, 0))  # disabled

# ---- group: B
b_2_12_0 = Point(Point(2, 12, 0))  # disabled

# ----
dedom2_8 = DeconstructDomain²(Domain=srf_4)  # -> UComponent, VComponent; disabled
dedom2_9 = DeconstructDomain²(Domain=srf_5)  # -> UComponent, VComponent; disabled
vec2pt_6 = Vector2Pt(PointA=pt_35, PointB=pt_36, Unitize=False)  # -> Vector, Length; disabled
vec2pt_7 = Vector2Pt(PointA=pt_38, PointB=pt_37, Unitize=False)  # -> Vector, Length; disabled

# ---- group: input curve
crv_18 = Curve(nurbs_9.Curve)  # disabled

# ----
# Full multiplicity knots at end
cp = ControlPoints(Curve=crv_9)  # -> Points, Weights, Knots; disabled

# ---- group: first curve tangent
panel_188 = Panel("1")  # disabled
cdiv = Derivatives(Curve=crv_4, Parameter=panel_188)  # -> Point, FirstDerivative; disabled

# ---- group: second curve tangent
panel_189 = Panel("0")  # disabled
cdiv_2 = Derivatives(Curve=crv_5, Parameter=panel_189)  # -> Point, FirstDerivative; disabled

# ----
crv_19 = Curve(ellipse.Ellipse)  # disabled

# ---- group: extract parameter "t" on curve
number_slider_24 = Slider(0.928, range=0..1)  # disabled
remap = RemapNumbers(Value=number_slider_24, Source=Domain(0, 1), Target=crv_19)  # -> Mapped, Clipped; disabled

# ---- group: Curvature Graph
number_slider_25 = Slider(109.4, range=100..110)  # disabled
crvgraph = CurvatureGraph(Curve=crv_19, Density=10, Scale=number_slider_25)  # disabled

# ---- group: first curve curvature
panel_190 = Panel("1")  # disabled
curvature = Curvature(Curve=crv_4, Parameter=panel_190)  # -> P, K, C; disabled

# ---- group: second curve curvature
panel_191 = Panel("0")  # disabled
curvature_2 = Curvature(Curve=crv_5, Parameter=panel_191)  # -> P, K, C; disabled

# ----
panel_192 = Panel(range_2)  # disabled
eval_7 = EvaluateCurve(Curve=reparameterize(crv_13), Parameter=range_5)  # -> Point, Tangent, Angle; disabled

# ---- group: Set domain to 0-100 (for comparison
crvdom = CurveDomain(Curve=intcrv.Curve, Domain=panel_180)  # -> Curve, Domain; disabled

# ---- group: linear curve
line_3 = Line(Line((10, 6, 0), (0, 8, 0)))  # disabled

# ----
panel_193 = Panel(range_3)  # disabled

# ---- group: Reset domain for clarity
crvdom_2 = CurveDomain(Curve=cir, Domain=panel_183)  # -> Curve, Domain; disabled

# ----
domcomp = DeconstructDomain(Domain=crv_11)  # -> Start, End; disabled
domcomp_2 = DeconstructDomain(Domain=crv_12)  # -> Start, End; disabled
python_6 = PythonScript(srf=[sph_2, cone.Cone])  # -> out, A; inputs srf: Brep; disabled
# ---------- python_6: Python ----------
#Decalre a new list of points
singular_points = []

#Examine all trims in the input brep
for trim in srf.Trims:

	#Null edge of a trim indicates a singularity
	if trim.Edge == None:
		#Find the 2D parameter space point at trim start or end
		pt2d = trim.PointAtStart
		
		#Evaluate trim end point on the object surface
		pt3d = trim.Face.PointAt(pt2d.X, pt2d.Y)
		
		#Add 3D point to the list of singular points
		singular_points.append(pt3d)
		
#Asign output
A = singular_points
# ---------- end python_6 ----------
# G0 continuity.
# Tagent at joint is different
crvgraph_2 = CurvatureGraph(Curve=crv_11, Density=5, Scale=number_slider_6)  # disabled
crvgraph_3 = CurvatureGraph(Curve=crv_12, Density=5, Scale=number_slider_6)  # disabled

# ---- group: analyze knots
cp_2 = ControlPoints(Curve=nurbs_17.Curve)  # -> Points, Weights, Knots; disabled

# ---- group: curve domain
domain_2 = Domain(crv_8)  # disabled

# ----
nurbs_19 = NurbsCurve(
    Vertices=[Point(0, 4, 0), Point(1, 3, 0), Point(2, 3, 0), Point(4, 4, 0), Point(7, 2, 0), Point(10, 2, 0)],
    Degree=3,
    Periodic=False)  # -> Curve, Length, Domain; disabled

# ---- group: analyze weights
cp_3 = ControlPoints(Curve=cir_3)  # -> Points, Weights, Knots; disabled

# ----
panel_194 = Panel(domain)  # disabled
toggle_6 = BooleanToggle(True)  # disabled
toggle_7 = BooleanToggle(True)  # disabled

# ---- group: analyze eights
cp_4 = ControlPoints(Curve=nurbs_18.Curve)  # -> Points, Weights, Knots; disabled

# ---- group: mid u
expression_8 = Expression(u0=dedom2num.UMin, u1=dedom2num.UMax, Expression="(u0+u1)/2")  # disabled

# ---- group: mid v
expression_9 = Expression(v0=dedom2num.VMin, v1=dedom2num.VMax, Expression="(v0+v1)/2")  # disabled

# ---- group: v domain
panel_195 = Panel(dedom2.VComponent)  # disabled

# ---- group: u domain
panel_196 = Panel(dedom2.UComponent)  # disabled

# ----
domcomp_3 = DeconstructDomain(Domain=crv_14)  # -> Start, End; disabled

# ---- group: normalized curve domain (set to 0 to 1)
crv_20 = Curve(reparameterize(nurbs_16.Curve))  # disabled

# ----
# G2 continuity.
# Tagent and curvature vectors are equal
crvgraph_4 = CurvatureGraph(Curve=crv_16, Density=5, Scale=number_slider_8)  # disabled
domcomp_4 = DeconstructDomain(Domain=crv_16)  # -> Start, End; disabled
crvgraph_5 = CurvatureGraph(Curve=crv_17, Density=5, Scale=number_slider_8)  # disabled
domcomp_5 = DeconstructDomain(Domain=crv_17)  # -> Start, End; disabled
domcomp_6 = DeconstructDomain(Domain=crv_15)  # -> Start, End; disabled
remap_2 = RemapNumbers(Value=panel_182, Source=Domain(0, 1), Target=dedom2_2.UComponent)  # -> Mapped, Clipped; disabled
remap_3 = RemapNumbers(Value=number_slider_12, Source=Domain(0, 1), Target=dedom2_2.VComponent)  # -> Mapped, Clipped; disabled
remap_4 = RemapNumbers(Value=number_slider_13, Source=Domain(0, 1), Target=dedom2_3.UComponent)  # -> Mapped, Clipped; disabled
remap_5 = RemapNumbers(Value=panel_181, Source=Domain(0, 1), Target=dedom2_3.VComponent)  # -> Mapped, Clipped; disabled
remap_6 = RemapNumbers(Value=panel_186, Source=Domain(0, 1), Target=dedom2_6.UComponent)  # -> Mapped, Clipped; disabled
remap_7 = RemapNumbers(Value=number_slider_17, Source=Domain(0, 1), Target=dedom2_6.VComponent)  # -> Mapped, Clipped; disabled
remap_8 = RemapNumbers(Value=number_slider_18, Source=Domain(0, 1), Target=dedom2_7.UComponent)  # -> Mapped, Clipped; disabled
remap_9 = RemapNumbers(Value=panel_187, Source=Domain(0, 1), Target=dedom2_7.VComponent)  # -> Mapped, Clipped; disabled

# ---- group: t
num_19 = Number(range_4)  # disabled

num_20 = Number(range_4)  # disabled

# ----
remap_10 = RemapNumbers(Value=panel_184, Source=Domain(0, 1), Target=dedom2_4.UComponent)  # -> Mapped, Clipped; disabled
remap_11 = RemapNumbers(Value=number_slider_15, Source=Domain(0, 1), Target=dedom2_4.VComponent)  # -> Mapped, Clipped; disabled
remap_12 = RemapNumbers(Value=number_slider_16, Source=Domain(0, 1), Target=dedom2_5.UComponent)  # -> Mapped, Clipped; disabled
remap_13 = RemapNumbers(Value=panel_185, Source=Domain(0, 1), Target=dedom2_5.VComponent)  # -> Mapped, Clipped; disabled

# ---- group: t
num_21 = Number(range_4)  # disabled

# ----
# G1 continuity.
# Tagent is equal, but curvature vector is different
crvgraph_6 = CurvatureGraph(Curve=crv_14, Density=5, Scale=number_slider_9)  # disabled
crvgraph_7 = CurvatureGraph(Curve=crv_15, Density=5, Scale=number_slider_9)  # disabled
vb_7 = VBScript(srf=[sph_4, cone_3.Cone])  # -> out, A; inputs srf: Brep; disabled
# ---------- vb_7: VB ----------
    'Decalre a new list of points
    Dim singular_points As New List( Of Point3d)

    'Examine all trims in the input
    For Each trim As BrepTrim In srf.Trims

      'Null edge of a trim indicates a singularity
      If trim.Edge Is Nothing Then

        'Find the 2D parameter space point of the start or end of the trim
        Dim pt2d = New Point2d(trim.PointAtStart)

        'Evaluate trim end point on the object surface
        Dim pt3d = trim.Face.PointAt(pt2d.x, pt2d.y)

        'Add 3D point to the list of singular points
        singular_points.Add(pt3d)
      End If

    Next

    'Asign output
    A = singular_points
# ---------- end vb_7 ----------
c_script_6 = CSharpScript(srf=[sph_3, cone_2.Cone])  # -> out, A; inputs srf: Brep; disabled
# ---------- c_script_6: C# ----------
    //Decalre a new list of points
    List < Point3d > singular_points = new List<Point3d>();

    //Examine all trims in the input
    foreach( BrepTrim trim in srf.Trims)
    {
      //Null edge of a trim indicates a singularity
      if( trim.Edge == null)
      {
        //Find the 2D parameter space point of the start or end of the trim
        Point2d pt2d = new Point2d(trim.PointAtStart);

        //Evaluate trim end point on the object surface
        Point3d pt3d = trim.Face.PointAt(pt2d.X, pt2d.Y);

        //Add 3D point to the list of singular points
        singular_points.Add(pt3d);
      }
    }

    //Asign output
    A = singular_points;
# ---------- end c_script_6 ----------
remap_14 = RemapNumbers(Value=number_slider_22, Source=Domain(0, 1), Target=dedom2_9.UComponent)  # -> Mapped, Clipped; disabled
remap_15 = RemapNumbers(Value=number_slider_21, Source=Domain(0, 1), Target=dedom2_9.VComponent)  # -> Mapped, Clipped; disabled

# ---- group: remap u domain
remap_16 = RemapNumbers(Value=number_slider_19, Source=Domain(0, 1), Target=dedom2_8.UComponent)  # -> Mapped, Clipped; disabled

# ---- group: remap v domain
remap_17 = RemapNumbers(Value=number_slider_20, Source=Domain(0, 1), Target=dedom2_8.VComponent)  # -> Mapped, Clipped; disabled

# ---- group: outside u
expression_10 = Expression(x=dedom2num_2.UMax, Expression="x+2")  # disabled

# ---- group: outside v
expression_11 = Expression(x=dedom2num_2.VMax, Expression="x+2")  # disabled

# ---- group: analyze knots
cp_5 = ControlPoints(Curve=nurbs_16.Curve)  # -> Points, Weights, Knots; disabled

# ---- group: parameter
panel_197 = Panel("17.5")  # disabled

# ---- group: single span cubic curve
bzspan = BezierSpan(StartPoint=pt_35, StartTangent=vec2pt_6.Vector, EndPoint=pt_38, EndTangent=vec2pt_7.Vector)  # -> Curve, Length, Domain; disabled

# ---- group: domain
domain_3 = Domain(nurbs_16.Curve)  # disabled

# ----
cp_6 = ControlPoints(Curve=crvdom.Curve)  # -> Points, Weights, Knots; disabled

# ---- group: curve domain
domain_4 = Domain(crv_18)  # disabled

# ----
panel_198 = Panel(domain_2)  # disabled

# ---- group: Parameters
panel_199 = Panel(range_5)  # disabled

# ---- group: parameter interval
domain_5 = Domain(line_2)  # disabled

# ---- group: evaluated point at parameter t=0.3
pt_39 = Point(eval_6.Point)  # disabled

# ---- group: Knots with kink
panel_200 = Panel(cp.Knots)  # disabled

# ---- group: surface parameter
number_slider_26 = Slider(0.548, range=0..1)  # disabled
number_slider_27 = Slider(0.333, range=0..1)  # disabled
panel_201 = Panel(",")  # disabled
concat = Concatenate(FragmentA=number_slider_26, FragmentB=panel_201, FragmentC=number_slider_27)  # disabled

# ---- group: u,v
# Gaussian and Mean curvatures
panel_202 = Panel(concat)  # disabled

panel_203 = Panel(concat)  # disabled

panel_204 = Panel(concat)  # disabled

# ----
curvature_3 = PrincipalCurvature(Surface=reparameterize(srf_19), Point=panel_203)  # -> Frame, Min, Max, MinDirection, MaxDirection; disabled
curvature_4 = PrincipalCurvature(Surface=reparameterize(srf_18), Point=panel_202)  # -> Frame, Min, Max, MinDirection, MaxDirection; disabled
cp_7 = ControlPoints(Curve=crvdom_2.Curve)  # -> Points, Weights, Knots; disabled
eval_8 = EvaluateCurve(Curve=crv_11, Parameter=domcomp.Start)  # -> Point, Tangent, Angle; disabled
curvature_5 = Curvature(Curve=crv_11, Parameter=domcomp.Start)  # -> P, K, C; disabled
eval_9 = EvaluateCurve(Curve=crv_12, Parameter=domcomp_2.End)  # -> Point, Tangent, Angle; disabled
curvature_6 = Curvature(Curve=crv_12, Parameter=domcomp_2.End)  # -> P, K, C; disabled

# ---- group: Evaluated points (varied distances)
pt_40 = Point(eval_7.Point)  # disabled

# ---- group: evaluate at parameter
eval_10 = EvaluateCurve(Curve=line_3, Parameter=range_2)  # -> Point, Tangent, Angle; disabled

# ---- group: reparameterize curve (set domain 0 to 1)
crv_21 = Curve(reparameterize(nurbs_19.Curve))  # disabled

# ---- group: M
expression_12 = Expression(A=a_7_4_0, B=b_2_12_0, t=num_19, Expression="A + t*(B-A)")  # disabled

# ---- group: O
expression_13 = Expression(C=c_24_14_0, D=d_28_4_0, t=num_21, Expression="C + t*(D-C)")  # disabled

# ---- group: N
expression_14 = Expression(B=b_2_12_0, C=c_24_14_0, t=num_20, Expression="B + t*(C-B)")  # disabled

# ----
panel_205 = Panel(cp_4.Weights)  # disabled
panel_206 = Panel(cp_3.Weights)  # disabled

# ---- group: singular points
panel_207 = Panel(python_6.A)  # disabled

# ----
eval_11 = EvaluateCurve(Curve=crv_14, Parameter=domcomp_3.Start)  # -> Point, Tangent, Angle; disabled
eval_12 = EvaluateCurve(Curve=crv_15, Parameter=domcomp_6.End)  # -> Point, Tangent, Angle; disabled
curvature_7 = Curvature(Curve=crv_14, Parameter=domcomp_3.Start)  # -> P, K, C; disabled
curvature_8 = Curvature(Curve=crv_15, Parameter=domcomp_6.End)  # -> P, K, C; disabled
eval_13 = EvaluateCurve(Curve=crv_16, Parameter=domcomp_4.Start)  # -> Point, Tangent, Angle; disabled
eval_14 = EvaluateCurve(Curve=crv_17, Parameter=domcomp_5.End)  # -> Point, Tangent, Angle; disabled
# Full multiplicity knots at start
# Simple knots
panel_208 = Panel(cp_2.Knots)  # disabled
curvature_9 = Curvature(Curve=crv_16, Parameter=domcomp_4.Start)  # -> P, K, C; disabled
curvature_10 = Curvature(Curve=crv_17, Parameter=domcomp_5.End)  # -> P, K, C; disabled
pt_41 = Point(vb_7.A)  # disabled

# ---- group: Knots with kink
# Full multiplicity knots at end
panel_209 = Panel("""0
0
0
2
2
2
4
4
4""")  # disabled

# ----
pt_42 = ConstructPoint(XCoordinate=remap_14.Mapped, YCoordinate=remap_15.Mapped, ZCoordinate=0)  # disabled

# ---- group: min curvature = 0
panel_210 = Panel(curvature_4.Max)  # disabled

# ---- group: analyze knots
cp_8 = ControlPoints(Curve=crv_20)  # -> Points, Weights, Knots; disabled

# ----
pt_43 = ConstructPoint(XCoordinate=remap_2.Mapped, YCoordinate=remap_3.Mapped, ZCoordinate=0)  # disabled
end = EndPoints(Curve=crv_4)  # -> Start, End; disabled
end_2 = EndPoints(Curve=crv_5)  # -> Start, End; disabled

# ---- group: NURBS curve
cp_9 = ControlPoints(Curve=reparameterize(nurbs_15.Curve))  # -> Points, Weights, Knots; disabled

# ---- group: max curvature = 1/r
panel_211 = Panel(curvature_4.Min)  # disabled

# ---- group: evaluate at parameter
eval_15 = EvaluateCurve(Curve=crv_8, Parameter=number_slider_23)  # -> Point, Tangent, Angle; disabled

# ----
pt_44 = ConstructPoint(XCoordinate=remap_4.Mapped, YCoordinate=remap_5.Mapped, ZCoordinate=0)  # disabled

# ---- group: domain
domain_6 = Domain(crv_20)  # disabled

# ---- group: mean curvature
expression_15 = Expression(x=curvature_3.Min, y=curvature_3.Max, Expression="(x+y)/2")  # disabled

# ----
panel_212 = Panel(domain_4)  # disabled

# ---- group: control polygon
cpoly = ControlPolygon(Curve=nurbs_7.Curve)  # -> Polygon, Points; disabled

# ----
pt_45 = ConstructPoint(XCoordinate=remap_10.Mapped, YCoordinate=remap_11.Mapped, ZCoordinate=0)  # disabled
pt_46 = ConstructPoint(XCoordinate=remap_12.Mapped, YCoordinate=remap_13.Mapped, ZCoordinate=0)  # disabled
pt_47 = ConstructPoint(XCoordinate=remap_6.Mapped, YCoordinate=remap_7.Mapped, ZCoordinate=0)  # disabled
pt_48 = ConstructPoint(XCoordinate=remap_8.Mapped, YCoordinate=remap_9.Mapped, ZCoordinate=0)  # disabled

# ---- group: NURBS curve
cp_10 = ControlPoints(Curve=nurbs_7.Curve)  # -> Points, Weights, Knots; disabled

# ---- group: control polygon
cpoly_2 = ControlPolygon(Curve=nurbs_15.Curve)  # -> Polygon, Points; disabled

# ---- group: singular points
panel_213 = Panel(vb_7.A)  # disabled

# ---- group: gaussian curvature
expression_16 = Expression(x=curvature_3.Min, y=curvature_3.Max, Expression="x*y")  # disabled

# ----
panel_214 = Panel(domain_5)  # disabled

# ---- group: Non-uniform knots
panel_215 = Panel(cp_6.Knots)  # disabled

# ---- group: (u,v)
pt_49 = ConstructPoint(XCoordinate=remap_16.Mapped, YCoordinate=remap_17.Mapped, ZCoordinate=0)  # disabled

# ---- group: surface curvature
curvature_11 = SurfaceCurvature(Surface=srf_20, Point=panel_204)  # -> Frame, Gaussian, Mean; disabled

# ---- group: singular points
panel_216 = Panel(c_script_6.A)  # disabled

# ---- group: evaluate at parameter
eval_16 = EvaluateCurve(Curve=crv_10, Parameter=number_slider_10)  # -> Point, Tangent, Angle; disabled

# ----
panel_217 = Panel(domain_3)  # disabled

# ---- group: compare tangents
dprod_10 = DotProduct(VectorA=cdiv.FirstDerivative, VectorB=cdiv_2.FirstDerivative, Unitize=toggle_6)  # disabled
panel_218 = Panel("1")  # disabled
equals = Equality(FirstNumber=dprod_10, SecondNumber=panel_218)  # -> Equality, Inequality; disabled

# ---- group: evaluate a curve at t
eval_17 = EvaluateCurve(Curve=vb_6.A, Parameter=panel_197)  # -> Point, Tangent, Angle; disabled

# ---- group: display tangent
vdis_28 = VectorDisplay(Anchor=[cdiv.Point, cdiv_2.Point], Vector=[cdiv.FirstDerivative, cdiv_2.FirstDerivative])  # disabled

# ---- group: curve domain
domain_7 = Domain(vb_6.A)  # disabled

# ---- group: (u,v)
pt_50 = ConstructPoint(XCoordinate=expression_8, YCoordinate=expression_9, ZCoordinate=0)  # disabled

# ---- group: (u.v)
pt_51 = ConstructPoint(XCoordinate=expression_10, YCoordinate=expression_11, ZCoordinate=0)  # disabled

# ----
panel_219 = Panel(cp_5.Knots)  # disabled
panel_220 = Panel(curvature_5.K)  # disabled
pt_52 = Point(eval_8.Point)  # disabled
panel_221 = Panel(eval_8.Point)  # disabled
panel_222 = Panel(eval_8.Tangent)  # disabled
pt_53 = Point(eval_9.Point)  # disabled
panel_223 = Panel(eval_9.Point)  # disabled
panel_224 = Panel(eval_9.Tangent)  # disabled
panel_225 = Panel(curvature_6.K)  # disabled

# ---- group: compare curvature vectors
dprod_11 = DotProduct(VectorA=curvature.K, VectorB=curvature_2.K, Unitize=toggle_7)  # disabled
panel_226 = Panel("1")  # disabled
equals_2 = Equality(FirstNumber=dprod_11, SecondNumber=panel_226)  # -> Equality, Inequality; disabled

# ----
crv_22 = Curve(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)  # disabled

# ---- group: display tangents
amp_3 = Amplitude(Vector=[curvature.K, curvature_2.K], Amplitude=10)  # disabled
vdis_29 = VectorDisplay(Anchor=[curvature.P, curvature_2.P], Vector=amp_3)  # disabled

# ---- group: Knots: non-uniform spacing
panel_227 = Panel(cp_7.Knots)  # disabled

# ---- group: Weights: rational
panel_228 = Panel(cp_7.Weights)  # disabled

# ---- group: evaluate at "normalized length" parameter
eval_18 = EvaluateLength(Curve=crv_10, Length=number_slider_10, Normalized=True)  # -> Point, Tangent, Parameter; disabled

# ----
number_slider_28 = Slider(2.96, range=0..5)  # disabled
panel_229 = Panel(eval_11.Point)  # disabled
panel_230 = Panel(eval_11.Tangent)  # disabled
panel_231 = Panel(curvature_7.K)  # disabled
panel_232 = Panel(eval_12.Point)  # disabled
panel_233 = Panel(eval_12.Tangent)  # disabled
panel_234 = Panel(curvature_8.K)  # disabled
panel_235 = Panel(remap.Mapped)  # disabled

# ---- group: evaluate surface
evalsrf_2 = EvaluateSurface(Surface=srf_5, Point=pt_42)  # -> Point, Normal, UDirection, VDirection, Frame; disabled

# ----
panel_236 = Panel(eval_13.Point)  # disabled
panel_237 = Panel(eval_13.Tangent)  # disabled
panel_238 = Panel(curvature_9.K)  # disabled
panel_239 = Panel(eval_14.Point)  # disabled
panel_240 = Panel(eval_14.Tangent)  # disabled
panel_241 = Panel(curvature_10.K)  # disabled

# ---- group: P1
pt_54 = Point(end.End)  # disabled

# ---- group: P2
pt_55 = Point(end_2.Start)  # disabled

# ----
number_slider_29 = Slider(1.67, range=0..5)  # disabled
panel_242 = Panel(domain_6)  # disabled
panel_243 = Panel(cp_8.Knots)  # disabled

# ---- group: srf2 curvature
osc = OsculatingCircles(Surface=srf_7, Point=pt_43)  # -> Point, FirstCircle, SecondCircle; disabled

osc_2 = OsculatingCircles(Surface=srf_8, Point=pt_44)  # -> Point, FirstCircle, SecondCircle; disabled

osc_3 = OsculatingCircles(Surface=srf_11, Point=pt_45)  # -> Point, FirstCircle, SecondCircle; disabled

osc_4 = OsculatingCircles(Surface=srf_12, Point=pt_46)  # -> Point, FirstCircle, SecondCircle; disabled

osc_5 = OsculatingCircles(Surface=srf_15, Point=pt_47)  # -> Point, FirstCircle, SecondCircle; disabled

osc_6 = OsculatingCircles(Surface=srf_16, Point=pt_48)  # -> Point, FirstCircle, SecondCircle; disabled

# ---- group: evaluate at parameter
eval_19 = EvaluateCurve(Curve=crv_21, Parameter=range_3)  # -> Point, Tangent, Angle; disabled

# ----
panel_244 = Panel(domain_7)  # disabled
vb_8 = VBScript(c1=crv_4, c2=crv_5)  # -> out, A; inputs c1: Curve, c2: Curve; disabled
# ---------- vb_8: VB ----------
    'declare variables
    Dim continuity As New String("")
    Dim t1, t2 As Double
    Dim v_c1, v_c2, c_c1, c_c2 As Vector3d

    'extract start and end points
    Dim end_c1 = c1.PointAtEnd
    Dim start_c2 = c2.PointAtStart

    'check G0 continuity
    If end_c1.DistanceTo(start_c2) = 0 Then
      continuity = "G0"
    End If

    'check G1 continuity
    If continuity = "G0" Then
      'calculate tangents
      v_c1 = c1.TangentAtEnd
      v_c2 = c2.TangentAtStart
      'unitize tangent vectors
      v_c1.Unitize
      v_c2.Unitize
      'compare tangents
      If v_c1 * v_c2 = 1.0 Then
        continuity = "G1"
      End If
    End If

    'check G2 continuity
    If continuity = "G1" Then
      'extract the parameter at start and end of the curves domain
      t1 = c1.Domain.Max
      t2 = c2.Domain.Min
      'calculate curvature
      c_c1 = c1.CurvatureAt(t1)
      c_c2 = c2.CurvatureAt(t2)
      'unitize curvature vectors
      c_c1.Unitize
      c_c2.Unitize
      'compare vectors
      If c_c1 * c_c2 = 1.0 Then
        continuity = "G2"
      End If
    End If

    'Assign output
    A = continuity
# ---------- end vb_8 ----------
c_script_7 = CSharpScript(c1=crv_4, c2=crv_5)  # -> out, A; inputs c1: Curve, c2: Curve; disabled
# ---------- c_script_7: C# ----------
    //decalre variables
    string continuity = ("");
    double t1, t2;
    Vector3d v_c1, v_c2, c_c1, c_c2;

    //extract start and end points
    Point3d end_c1 = c1.PointAtEnd;
    Point3d start_c2 = c2.PointAtStart;

    //check G0 continuity
    if( end_c1.DistanceTo(start_c2) == 0){
      continuity = "G0";
    }

    //check G1 continuity
    if( continuity == "G0")
    {
      //calculate tangents
      v_c1 = c1.TangentAtEnd;
      v_c2 = c2.TangentAtStart;
      //unitize tangent vectors
      v_c1.Unitize();
      v_c2.Unitize();
      //compare tangents
      if( v_c1 * v_c2 == 1.0 ){
        continuity = "G1";
      }
    }

    //check G2 continuity
    if( continuity == "G1" )
    {
      //extract the parameter at start and end of the curves domain
      t1 = c1.Domain.Max;
      t2 = c2.Domain.Min;
      //calculate curvature
      c_c1 = c1.CurvatureAt(t1);
      c_c2 = c2.CurvatureAt(t2);
      //unitize curvature vectors
      c_c1.Unitize();
      c_c2.Unitize();
      //compare vectors
      if( c_c1 * c_c2 == 1.0 ){
        continuity = "G2";
      }
    }

    //assign output
    A = continuity;
# ---------- end c_script_7 ----------

# ---- group: evaluate surface
evalsrf_3 = EvaluateSurface(Surface=srf_4, Point=pt_49)  # -> Point, Normal, UDirection, VDirection, Frame; disabled

# ----
python_7 = PythonScript(c1=crv_4, c2=crv_5)  # -> out, A; inputs c1: Curve, c2: Curve; disabled
# ---------- python_7: Python ----------
#decalre variables
continuity = ""

#extract start and end points
end_c1 = c1.PointAtEnd
start_c2 = c2.PointAtStart

#check G0 continuity
if end_c1.DistanceTo(start_c2) == 0:
    continuity = "G0"

#check G1 continuity
if continuity == "G0":
    #calculate tangents
    v_c1 = c1.TangentAtEnd
    v_c2 = c2.TangentAtStart
    #unitize tangent vectors
    v_c1.Unitize()
    v_c2.Unitize()
    #compare tangents
    dot = v_c1 * v_c2
    if dot == 1.0:
        continuity = "G1"
    else:
        print("Failed G1")
        print(dot)
        
#check G2 continuity
if continuity == "G1":
    
    #extract the parameter at start and end of the curves domain
    t1 = c1.Domain.Max
    t2 = c2.Domain.Min
    #calculate curvature
    c_c1 = c1.CurvatureAt(t1)
    c_c2 = c2.CurvatureAt(t2)
    #unitize curvature vectors
    c_c1.Unitize()
    c_c2.Unitize()
    #compare vectors
    dot = c_c1 * c_c2
    if dot == 1.0:
        continuity = "G2"
    else:
        print("Failed G2")
        print(dot)
        
#assign output
A = continuity
# ---------- end python_7 ----------
control_points = Panel(cp_10.Points)  # disabled
weights = Panel(cp_10.Weights)  # disabled
panel_245 = Panel(expression_15)  # disabled
panel_246 = Panel(curvature_11.Gaussian)  # disabled
panel_247 = Panel(curvature_11.Mean)  # disabled
panel_248 = Panel(expression_16)  # disabled
cp_11 = ControlPoints(Curve=crv_22)  # -> Points, Weights, Knots; disabled
control_points_2 = Panel(cp_9.Points)  # disabled
weights_2 = Panel(cp_9.Weights)  # disabled
knots = Panel(cp_9.Knots)  # disabled
knots_2 = Panel(cp_10.Knots)  # disabled

# ---- group: t
num_22 = Number(range_4)  # disabled

# ----
equals_3 = Equality(FirstNumber=pt_54, SecondNumber=pt_55)  # -> Equality, Inequality; disabled

# ---- group: t
num_23 = Number(range_4)  # disabled

# ---- group: evaluate surface
evalsrf_4 = EvaluateSurface(Surface=srf_3, Point=pt_50)  # -> Point, Normal, UDirection, VDirection, Frame; disabled

evalsrf_5 = EvaluateSurface(Surface=srf_2, Point=pt_51)  # -> Point, Normal, UDirection, VDirection, Frame; disabled

# ---- group: (B) curve with kink
nurbcrv = NurbsCurvePWK(Points=cp_2.Points, Weights=cp_2.Weights, Knots=panel_209)  # -> Curve, Length, Domain; disabled

# ----
image = ImageSampler(Filter="Colour", Interpolate=False, Umax=1, Umin=0, Vmax=1, Vmin=0, Wrap=1)  # disabled

# ---- group: curvature at "t"
curvature_12 = Curvature(Curve=crv_19, Parameter=remap.Mapped)  # -> P, K, C; disabled

# ----
srf_cp_2 = SurfaceClosestPoint(Point=osc.Point, Surface=srf_6)  # -> Point, UVPoint, Distance; disabled
srf_cp_3 = SurfaceClosestPoint(Point=osc_2.Point, Surface=srf_9)  # -> Point, UVPoint, Distance; disabled

# ---- group: evaluated point at parameter t=0.3
pt_56 = Point(eval_17.Point)  # disabled

# ---- group: tangent vector at "t"
eval_20 = EvaluateCurve(Curve=crv_19, Parameter=remap.Mapped)  # -> Point, Tangent, Angle; disabled
panel_249 = Panel(eval_20.Tangent)  # disabled

# ---- group: Uniform option create uniform curve that might not be as smooth
# Compare knot spacing
list_2 = ValueList({"Uniform": 0, "Chord": 1, "Sqr Chord": 2}, selected="Uniform")  # disabled

# ----
srf_cp_4 = SurfaceClosestPoint(Point=osc_3.Point, Surface=srf_10)  # -> Point, UVPoint, Distance; disabled
srf_cp_5 = SurfaceClosestPoint(Point=osc_4.Point, Surface=srf_13)  # -> Point, UVPoint, Distance; disabled
srf_cp_6 = SurfaceClosestPoint(Point=osc_5.Point, Surface=srf_14)  # -> Point, UVPoint, Distance; disabled
srf_cp_7 = SurfaceClosestPoint(Point=osc_6.Point, Surface=srf_17)  # -> Point, UVPoint, Distance; disabled

# ---- group: deconstruct tangent plane
deplane = DeconstructPlane(Plane=evalsrf_2.Point)  # -> Origin, XAxis, YAxis, ZAxis; disabled

# ----
crv_23 = Curve(osc.FirstCircle)  # disabled
crv_24 = Curve(osc.SecondCircle)  # disabled
crv_25 = Curve(osc_2.FirstCircle)  # disabled
crv_26 = Curve(osc_2.SecondCircle)  # disabled

# ---- group: P
expression_17 = Expression(M=expression_12, N=expression_14, t=num_23, Expression="M + t*(N-M)")  # disabled

# ---- group: Q
expression_18 = Expression(N=expression_14, O=expression_13, t=num_22, Expression="N + t*(O-N)")  # disabled

# ----
crv_27 = Curve(osc_3.FirstCircle)  # disabled
crv_28 = Curve(osc_3.SecondCircle)  # disabled
crv_29 = Curve(osc_4.FirstCircle)  # disabled
crv_30 = Curve(osc_4.SecondCircle)  # disabled
crv_31 = Curve(osc_5.FirstCircle)  # disabled
crv_32 = Curve(osc_5.SecondCircle)  # disabled
crv_33 = Curve(osc_6.FirstCircle)  # disabled
crv_34 = Curve(osc_6.SecondCircle)  # disabled
panel_250 = Panel(c_script_7.A)  # disabled
panel_251 = Panel(vb_8.A)  # disabled
A_9 = Slider(11, range=10..20)  # disabled
panel_252 = Panel(python_7.A)  # disabled
amp_4 = Amplitude(Vector=eval_18.Tangent, Amplitude=number_slider_28)  # disabled

# ---- group: Knots with kink
panel_253 = Panel(cp_11.Knots)  # disabled

# ----
amp_5 = Amplitude(Vector=eval_16.Tangent, Amplitude=number_slider_29)  # disabled

# ---- group: G0
bool = Boolean(equals_3.Equality)  # disabled

# ---- group: G1
bool_2 = Boolean(equals.Equality)  # disabled

# ---- group: G2
bool_3 = Boolean(equals_2.Equality)  # disabled

# ---- group: srf1 curvature
osc_7 = OsculatingCircles(Surface=srf_6, Point=srf_cp_2.UVPoint)  # -> Point, FirstCircle, SecondCircle; disabled

# ---- group: sr3 curvature
osc_8 = OsculatingCircles(Surface=srf_9, Point=srf_cp_3.UVPoint)  # -> Point, FirstCircle, SecondCircle; disabled

# ---- group: Uniform interpolate curve
intcrv_2 = Interpolate(Vertices=pt_32, Degree=panel_152, Periodic=False, KnotStyle=list_2)  # -> Curve, Length, Domain; disabled

# ---- group: srf1 curvature
osc_9 = OsculatingCircles(Surface=srf_10, Point=srf_cp_4.UVPoint)  # -> Point, FirstCircle, SecondCircle; disabled

# ---- group: sr3 curvature
osc_10 = OsculatingCircles(Surface=srf_13, Point=srf_cp_5.UVPoint)  # -> Point, FirstCircle, SecondCircle; disabled

# ---- group: srf1 curvature
osc_11 = OsculatingCircles(Surface=srf_14, Point=srf_cp_6.UVPoint)  # -> Point, FirstCircle, SecondCircle; disabled

# ---- group: sr3 curvature
osc_12 = OsculatingCircles(Surface=srf_17, Point=srf_cp_7.UVPoint)  # -> Point, FirstCircle, SecondCircle; disabled

# ---- group: t
num_24 = Number(range_4)  # disabled

# ----
panel_254 = Panel(python_7.out)  # disabled
vdis_30 = VectorDisplay(Anchor=eval_18.Point, Vector=amp_4)  # disabled
and = GateAnd(A=bool, B=bool_2)  # disabled

# ---- group: view curvature vector at "t"
len = Length(Curve=curvature_12.C)  # disabled
amp_6 = Amplitude(Vector=[curvature_12.K, eval_20.Tangent], Amplitude=expr("x/(2*Pi)", len))  # disabled
vdis_31 = VectorDisplay(Anchor=curvature_12.P, Vector=amp_6)  # disabled

# ----
vdis_32 = VectorDisplay(Anchor=eval_16.Point, Vector=amp_5)  # disabled

# ---- group: curvature vector at "t"
panel_255 = Panel(curvature_12.K)  # disabled

# ----
panel_256 = Panel("0 to 100")  # disabled
crv_35 = Curve(osc_7.FirstCircle)  # disabled
crv_36 = Curve(osc_7.SecondCircle)  # disabled
crv_37 = Curve(osc_8.FirstCircle)  # disabled
crv_38 = Curve(osc_8.SecondCircle)  # disabled

# ---- group: weights
# Figure (49): Analyze the effect of weights on a clamped rational curve
number_slider_30 = Slider(1.16, range=0.001..5)  # disabled
number_slider_31 = Slider(0.66, range=0.001..5)  # disabled
number_slider_32 = Slider(0.141, range=0.001..5)  # disabled
number_slider_33 = Slider(1.32, range=0.001..5)  # disabled
merge = Merge(Data1=number_slider_30, Data2=number_slider_31, Data3=number_slider_32, Data4=number_slider_33)  # disabled

# ----
crv_39 = Curve(osc_9.FirstCircle)  # disabled
crv_40 = Curve(osc_9.SecondCircle)  # disabled
crv_41 = Curve(osc_10.FirstCircle)  # disabled
crv_42 = Curve(osc_10.SecondCircle)  # disabled
crv_43 = Curve(osc_11.FirstCircle)  # disabled
crv_44 = Curve(osc_11.SecondCircle)  # disabled
crv_45 = Curve(osc_12.FirstCircle)  # disabled
crv_46 = Curve(osc_12.SecondCircle)  # disabled

# ---- group: weights (for degree 2 curve)
# Figure (50): Analyze the effect of weights on a periodic rational curve
number_slider_34 = Slider(0.2, range=0.001..5)  # disabled
number_slider_35 = Slider(0.3, range=0.001..5)  # disabled
number_slider_36 = Slider(1.5, range=0.001..5)  # disabled
number_slider_37 = Slider(1, range=0.001..5)  # disabled
number_slider_38 = Slider(0.3, range=0.001..5)  # disabled
number_slider_39 = Slider(0.3, range=0.001..5)  # disabled
merge_2 = Merge(
    Data1=number_slider_34,
    Data2=number_slider_35,
    Data3=number_slider_36,
    Data4=number_slider_37,
    Data5=number_slider_38,
    Data6=number_slider_39)  # disabled

# ---- group: R
expression_19 = Expression(P=expression_17, Q=expression_18, t=num_24, Expression="P + t*(Q-P)")  # disabled

# ---- group: weights (for degree 3 curve)
number_slider_40 = Slider(0.2, range=0.001..5)  # disabled
number_slider_41 = Slider(0.3, range=0.001..5)  # disabled
number_slider_42 = Slider(1.5, range=0.001..5)  # disabled
number_slider_43 = Slider(1, range=0.001..5)  # disabled
number_slider_44 = Slider(0.3, range=0.001..5)  # disabled
number_slider_45 = Slider(0.3, range=0.001..5)  # disabled
number_slider_46 = Slider(0.3, range=0.001..5)  # disabled
merge_3 = Merge(
    Data1=number_slider_40,
    Data2=number_slider_41,
    Data3=number_slider_42,
    Data4=number_slider_43,
    Data5=number_slider_44,
    Data6=number_slider_45,
    Data7=number_slider_46)  # disabled

# ----
and_2 = GateAnd(A=and, B=bool_3)  # disabled
panel_257 = Panel("False")  # disabled

# ---- group: Set domain to 0-100 (for comparison
crvdom_3 = CurveDomain(Curve=intcrv_2.Curve, Domain=panel_256)  # -> Curve, Domain; disabled

# ---- group: normal to surface
amp_7 = Amplitude(Vector=deplane.ZAxis, Amplitude=A_9)  # disabled

# ---- group: tangent in u dir
amp_8 = Amplitude(Vector=deplane.XAxis, Amplitude=A_9)  # disabled

# ---- group: tangent in v dir
amp_9 = Amplitude(Vector=deplane.YAxis, Amplitude=A_9)  # disabled

# ----
cp_12 = ControlPoints(Curve=crvdom_3.Curve)  # -> Points, Weights, Knots; disabled
merge_4 = Merge(Data1=and_2, Data2=and, Data3=bool, Data4=panel_257)  # disabled
panel_258 = Panel("""G2
G1
G0
Not""")  # disabled
vdis_33 = VectorDisplay(Anchor=deplane.Origin, Vector=amp_7)  # disabled
vdis_34 = VectorDisplay(Anchor=deplane.Origin, Vector=amp_8)  # disabled
vdis_35 = VectorDisplay(Anchor=deplane.Origin, Vector=amp_9)  # disabled
dispatch = Dispatch(List=panel_258, DispatchPattern=merge_4)  # -> ListA, ListB; disabled

# ---- group: Uniform knots
# P1
# A=0.2*P1+ 0.8*P2
# D=0.2*A + 0.8*B
# P2
# B=0.47*P2 + 0.53*P3
# E=0.7*B + 0.3*C
# P3
# C=0.8*P3 + 0.2*P4
# P4
panel_259 = Panel(cp_12.Knots)  # disabled

# ----
panel_260 = Panel("0")  # disabled

# ---- group: NURBS curve
nurbcrv_2 = NurbsCurve(Points=cp_9.Points, Weights=merge, Knots=cp_9.Knots)  # -> Curve, Length, Domain; disabled

nurbcrv_3 = NurbsCurve(Points=cp_10.Points, Weights=merge_2, Knots=cp_10.Knots)  # -> Curve, Length, Domain; disabled

# ----
item = ListItem(List=dispatch.ListA, Index=panel_260, Wrap=True)  # disabled
panel_261 = Panel(item)  # disabled
cp_13 = ControlPoints(Curve=nurbcrv_2.Curve)  # -> Points, Weights, Knots; disabled
cp_14 = ControlPoints(Curve=nurbcrv_3.Curve)  # -> Points, Weights, Knots; disabled
knots_3 = Panel(cp_13.Knots)  # disabled
control_points_3 = Panel(cp_13.Points)  # disabled
weights_3 = Panel(cp_13.Weights)  # disabled
control_points_4 = Panel(cp_14.Points)  # disabled
weights_4 = Panel(cp_14.Weights)  # disabled
knots_4 = Panel(cp_14.Knots)  # disabled
